# Dynamo graph Fire Damper Placement script R6.dyn (Dynamo 2.12.1.8246)
# packages: DarCDT 1.0.0, bimorphNodes 5.1.3, Synthesize toolkit 12.7.5, DynaMEP 2.0.1, OpenMEP 1.0.0, archi-lab.net 2025.300.1225, archi-lab.net 2022.212.3222

code_block = CodeBlock { true; }

# group: UI - Ducts
firedamper_SelectDuctUI = ScriptUI.Firedamper_SelectDuctUI(Run=code_block)

# group: Wall mounted air terminal (horizontal) clashing with ducts
python_script = Python(IN[0]=firedamper_SelectDuctUI.Air_terminals)  # CPython3
# ---------- python_script.python (196 lines) ----------
import clr
import sys

# Import Dynamo Geometry for safe point creation
clr.AddReference('ProtoGeometry')
from Autodesk.DesignScript import Geometry as dg

clr.AddReference('RevitAPI')
from Autodesk.Revit.DB import *
from Autodesk.Revit.DB.Mechanical import *

clr.AddReference('RevitNodes')
import Revit
clr.ImportExtensions(Revit.Elements)
clr.ImportExtensions(Revit.GeometryConversion)

# --- METRIC TOLERANCES ---
MIN_DUCT_LEN_FT = 250.0 / 304.8 
MAX_DAMPER_DIST_FT = 500.0 / 304.8 
OFFSET_DIST_FT = 100.0 / 304.8 # Exact 200mm distance
FEET_TO_MM = 304.8

def safe_wrap(elem):
    """Safely wraps a Revit element for Dynamo, catching InvalidObjectExceptions."""
    if elem is None: return None
    try:
        return elem.ToDSType(True)
    except:
        try: return "Unwrappable Element ID: " + str(elem.Id.IntegerValue)
        except: return "Invalid Internal Element"

def is_fire_damper(element):
    """Helper to check if an element is a Fire Damper based on Family Name."""
    if not isinstance(element, FamilyInstance): 
        return False
        
    if element.Category and element.Category.Id.IntegerValue == int(BuiltInCategory.OST_DuctAccessory):
        try:
            fam_name = element.Symbol.FamilyName.lower()
            if "fire" in fam_name and "damper" in fam_name:
                return True
        except: pass
    return False

def check_duct_for_damper(duct):
    """Helper to check all elements physically connected to the duct for a Fire Damper."""
    cm = duct.ConnectorManager
    for conn in cm.Connectors:
        if conn.IsConnected:
            for ref in conn.AllRefs:
                neighbor = ref.Owner
                if neighbor.Id == duct.Id: continue
                if isinstance(neighbor, MechanicalSystem): continue
                
                if neighbor.IsValidObject and is_fire_damper(neighbor):
                    return True
    return False

def get_full_chain(terminal):
    chain = [safe_wrap(terminal)]
    current = terminal
    prev_id = terminal.Id
    
    # Traverse the system
    for _ in range(30): 
        next_elem = None
        
        if hasattr(current, "ConnectorManager"):
            cm = current.ConnectorManager
        elif hasattr(current, "MEPModel") and current.MEPModel:
            cm = current.MEPModel.ConnectorManager
        else:
            break

        if not cm: break

        for conn in cm.Connectors:
            if not conn.IsConnected: continue
            
            for link in conn.AllRefs:
                neighbor = link.Owner
                
                if neighbor.Id != current.Id and neighbor.Id != prev_id and not isinstance(neighbor, MechanicalSystem):
                    if neighbor.IsValidObject:
                        next_elem = neighbor
                        break
            if next_elem: break
        
        if next_elem:
            # --- CONDITION 1: IS IT A TEE? ---
            if isinstance(next_elem, FamilyInstance) and hasattr(next_elem, "MEPModel") and next_elem.MEPModel:
                if hasattr(next_elem.MEPModel, "PartType"):
                    if next_elem.MEPModel.PartType == PartType.Tee:
                        return "Tee found before duct"
            
            # --- CONDITION 2: IS IT ALREADY A DAMPER RIGHT OFF THE FITTING? ---
            if is_fire_damper(next_elem):
                return "Fire damper is already placed"
                
            # Safely wrap before appending
            chain.append(safe_wrap(next_elem))
            
            # --- CONDITION 3: IS IT A SUITABLE DUCT? ---
            if isinstance(next_elem, Duct):
                param = next_elem.get_Parameter(BuiltInParameter.CURVE_ELEM_LENGTH)
                if param:
                    length_ft = param.AsDouble()
                    
                    if length_ft >= MIN_DUCT_LEN_FT:
                        if check_duct_for_damper(next_elem):
                            if length_ft <= MAX_DAMPER_DIST_FT:
                                return "Fire damper is already placed"
                                
                        # --- NEW: CALCULATE THE 200mm INSERTION POINT ---
                        damper_pt = None
                        try:
                            curve = next_elem.Location.Curve
                            p0 = curve.GetEndPoint(0)
                            p1 = curve.GetEndPoint(1)
                            
                            # Find the origin of the fitting we just came from
                            prev_origin = None
                            try:
                                if current.Location and hasattr(current.Location, "Point"):
                                    prev_origin = current.Location.Point
                                else:
                                    prev_origin = current.GetTransform().Origin
                            except:
                                prev_origin = p0
                                
                            # Compare distances to find which end of the duct connects to the fitting
                            if prev_origin.DistanceTo(p0) < prev_origin.DistanceTo(p1):
                                start_pt = p0
                                end_pt = p1
                            else:
                                start_pt = p1
                                end_pt = p0
                                
                            # Generate Vector and calculate 200mm offset
                            direction = end_pt.Subtract(start_pt).Normalize()
                            offset_xyz = start_pt.Add(direction.Multiply(OFFSET_DIST_FT))
                            
                            # Safely convert to a Dynamo Workspace Point (Metric)
                            damper_pt = dg.Point.ByCoordinates(offset_xyz.X * FEET_TO_MM, offset_xyz.Y * FEET_TO_MM, offset_xyz.Z * FEET_TO_MM)
                        except:
                            pass
                            
                        # Return both the chain and the placement point
                        return {"Chain": chain, "DamperPoint": damper_pt}

            prev_id = current.Id
            current = next_elem
        else:
            break
            
    return "No suitable duct > 250mm found"

# --- Input/Output Logic ---
input_items = IN[0] if isinstance(IN[0], list) else [IN[0]]

# Initialize our dictionaries. Success now holds the 200mm insertion point.
success_dict = {"AirTerminals": [], "Chains": [], "DamperPoints": []}
warning_dict = {"AirTerminals": [], "Warnings": []}

for item in input_items:
    try:
        terminal_obj = UnwrapElement(item)
        
        if terminal_obj and terminal_obj.IsValidObject:
            result = get_full_chain(terminal_obj)
            
            # Check if it successfully returned our dictionary
            if isinstance(result, dict):
                success_dict["AirTerminals"].append(safe_wrap(terminal_obj))
                success_dict["Chains"].append(result["Chain"])
                success_dict["DamperPoints"].append(result["DamperPoint"])
            else:
                # 2. ALREADY PLACED: Ignore entirely
                if result == "Fire damper is already placed":
                    continue
                    
                # 3. WARNING: Add to the parallel Warning lists
                warning_dict["AirTerminals"].append(safe_wrap(terminal_obj))
                warning_dict["Warnings"].append(result)
        else:
            warning_dict["AirTerminals"].append("Null/Deleted Input")
            warning_dict["Warnings"].append("Invalid or Null Input Element")
            
    except Exception as e:
        warning_dict["AirTerminals"].append("Error")
        warning_dict["Warnings"].append("PYTHON ERROR: " + str(e))

# Output parallel dictionaries
# OUT[0] = Success Dictionary
# OUT[1] = Warning Dictionary
OUT = [success_dict, warning_dict]
# ----------------------------------------
code_block_2 = CodeBlock(DIC_=python_script) { DIC_[0]; }
code_block_3 = CodeBlock { "DamperPoints"; "AirTerminals"; "Chains"; }
valueAtKey = DesignScript.Builtin.Dictionary.ValueAtKey(dictionary=code_block_2, key=code_block_3.out1)
valueAtKey_2 = DesignScript.Builtin.Dictionary.ValueAtKey(dictionary=code_block_2, key=code_block_3.out2)
valueAtKey_3 = DesignScript.Builtin.Dictionary.ValueAtKey(dictionary=code_block_2, key=code_block_3.out0)

join = List.Join(list0=firedamper_SelectDuctUI.Ducts, list1=valueAtKey)

# group: Checking ducts levels
ducts_only = Python(IN[0]=join)  # CPython3; unwired: IN[1]
# ---------- ducts_only.python (220 lines) ----------
# -*- coding: utf-8 -*-
import clr

clr.AddReference('ProtoGeometry')
from Autodesk.DesignScript import Geometry as dg

clr.AddReference('RevitAPI')
from Autodesk.Revit.DB import XYZ, ViewPlan, ViewType, BuiltInParameter, FilteredElementCollector, Plane

clr.AddReference('RevitNodes')
import Revit
clr.ImportExtensions(Revit.Elements)
clr.ImportExtensions(Revit.GeometryConversion) 

clr.AddReference('RevitServices')
from RevitServices.Persistence import DocumentManager

doc = DocumentManager.Instance.CurrentDBDocument

# --------------------------------------------------
# Helpers
# --------------------------------------------------
def is_floor_plan_view(v):
    try:
        if not isinstance(v, ViewPlan): return False
        if v.ViewType != ViewType.FloorPlan: return False
        if hasattr(v, "IsTemplate") and v.IsTemplate: return False
        try:
            dep_param = v.get_Parameter(BuiltInParameter.VIEW_DEPENDENCY)
            if dep_param and dep_param.AsInteger() != 0: return False
        except: pass
        if not hasattr(v, "GenLevel") or v.GenLevel is None: return False
        return True
    except: return False

def bbox_intersects_dynamo(bb_elem, bb_level, tol=0.0):
    """Checks if two Dynamo bounding boxes intersect in 3D space."""
    if bb_elem is None or bb_level is None: return False
    
    e_min, e_max = bb_elem.MinPoint, bb_elem.MaxPoint
    l_min, l_max = bb_level.MinPoint, bb_level.MaxPoint
    
    if (e_max.X + tol < l_min.X) or (e_min.X - tol > l_max.X): return False
    if (e_max.Y + tol < l_min.Y) or (e_min.Y - tol > l_max.Y): return False
    if (e_max.Z + tol < l_min.Z) or (e_min.Z - tol > l_max.Z): return False
    
    return True

def flatten_parallel(items, coords):
    """Recursively flattens nested lists while keeping Elements and CoordinateSystems paired."""
    flat_items = []
    flat_coords = []
    
    if isinstance(items, (list, tuple)):
        # Ensure coords is also a list for safe indexing
        c_list = coords if isinstance(coords, (list, tuple)) else [coords] * len(items)
        
        for i in range(len(items)):
            c_item = c_list[i] if i < len(c_list) else None
            sub_items, sub_coords = flatten_parallel(items[i], c_item)
            flat_items.extend(sub_items)
            flat_coords.extend(sub_coords)
        return flat_items, flat_coords
    else:
        return [items], [coords]

# --------------------------------------------------
# Main
# --------------------------------------------------

raw_elements = UnwrapElement(IN[0])
raw_coords = UnwrapElement(IN[1])

# Flatten the nested lists in perfect synchronization
flat_elements, flat_coords = flatten_parallel(raw_elements, raw_coords)

# --------------------------------------------------
# STEP 1: Get Element BBXs and Transform
# --------------------------------------------------

dynamo_element_bboxes = []

for e, cs in zip(flat_elements, flat_coords):
    if e is None: 
        dynamo_element_bboxes.append(None)
        continue
    try:
        bb = e.get_BoundingBox(None)
        if bb is None: 
            dynamo_element_bboxes.append(None)
            continue

        dyn_bb = bb.ToProtoType()

        if cs is not None and isinstance(cs, dg.CoordinateSystem):
            p_min = dyn_bb.MinPoint
            p_max = dyn_bb.MaxPoint
            
            corners = [
                dg.Point.ByCoordinates(p_min.X, p_min.Y, p_min.Z),
                dg.Point.ByCoordinates(p_min.X, p_min.Y, p_max.Z),
                dg.Point.ByCoordinates(p_min.X, p_max.Y, p_min.Z),
                dg.Point.ByCoordinates(p_min.X, p_max.Y, p_max.Z),
                dg.Point.ByCoordinates(p_max.X, p_min.Y, p_min.Z),
                dg.Point.ByCoordinates(p_max.X, p_min.Y, p_max.Z),
                dg.Point.ByCoordinates(p_max.X, p_max.Y, p_min.Z),
                dg.Point.ByCoordinates(p_max.X, p_max.Y, p_max.Z)
            ]
            
            transformed_pts = [pt.Transform(cs) for pt in corners]
            
            tx = [p.X for p in transformed_pts]
            ty = [p.Y for p in transformed_pts]
            tz = [p.Z for p in transformed_pts]
            
            pmin_new = dg.Point.ByCoordinates(min(tx), min(ty), min(tz))
            pmax_new = dg.Point.ByCoordinates(max(tx), max(ty), max(tz))
            dynamo_element_bboxes.append(dg.BoundingBox.ByCorners(pmin_new, pmax_new))
        else:
            dynamo_element_bboxes.append(dyn_bb)
            
    except:
        dynamo_element_bboxes.append(None)

# --------------------------------------------------
# STEP 2: Create GLOBAL X/Y Limits
# --------------------------------------------------

dyn_xs, dyn_ys = [], []

for dbb in dynamo_element_bboxes:
    if dbb is None: continue
    dyn_xs.extend([dbb.MinPoint.X, dbb.MaxPoint.X])
    dyn_ys.extend([dbb.MinPoint.Y, dbb.MaxPoint.Y])

if not dyn_xs:
    OUT = [[], [], [], "No valid elements found"]
else:
    globalMinX = min(dyn_xs)
    globalMaxX = max(dyn_xs)
    globalMinY = min(dyn_ys)
    globalMaxY = max(dyn_ys)

    # --------------------------------------------------
    # STEP 3: Collect Floor Plan Levels
    # --------------------------------------------------
    all_viewplans = FilteredElementCollector(doc).OfClass(ViewPlan).ToElements()
    floor_plans = [v for v in all_viewplans if is_floor_plan_view(v)]

    level_dict = {}
    for vp in floor_plans:
        try:
            if vp.GenLevel:
                level_dict[vp.GenLevel.Id] = vp.GenLevel
        except: pass

    levels = list(level_dict.values())
    levels.sort(key=lambda l: l.Elevation)

    # --------------------------------------------------
    # STEP 4: Build Level Bounding Boxes (UPDATED GAP LOGIC)
    # --------------------------------------------------
    level_bboxes = []
    
    gap_mm = 20.0 # Creates a 20mm dead zone above and below floors
    default_height_mm = 6000.0

    for i, lvl in enumerate(levels):
        try: elev = lvl.ProjectElevation
        except: elev = lvl.Elevation 
            
        pt_xyz = XYZ(0, 0, elev)
        dyn_plane = Plane.CreateByNormalAndOrigin(XYZ.BasisZ, pt_xyz).ToPlane()
        base_z_mm = dyn_plane.Origin.Z

        # Add the gap to push the bounding box UP from the slab
        zBottom_mm = base_z_mm + gap_mm
        
        if i < len(levels) - 1:
            try: next_elev = levels[i+1].ProjectElevation
            except: next_elev = levels[i+1].Elevation
                
            next_pt = XYZ(0, 0, next_elev)
            next_z_mm = Plane.CreateByNormalAndOrigin(XYZ.BasisZ, next_pt).ToPlane().Origin.Z
            
            # Subtract the gap to pull the bounding box DOWN from the next slab
            zTop_mm = next_z_mm - gap_mm
        else:
            # If it's the top level, apply the default height and still subtract the gap
            zTop_mm = base_z_mm + default_height_mm - gap_mm

        pmin_lvl = dg.Point.ByCoordinates(globalMinX, globalMinY, zBottom_mm)
        pmax_lvl = dg.Point.ByCoordinates(globalMaxX, globalMaxY, zTop_mm)
        
        lvl_bbx = dg.BoundingBox.ByCorners(pmin_lvl, pmax_lvl)
        level_bboxes.append(lvl_bbx)

    # --------------------------------------------------
    # STEP 5: Group Elements & Transforms Per Level
    # --------------------------------------------------
    elements_per_level = []
    coords_per_level = []  
    tol_mm = 1.0 

    for lvbb in level_bboxes:
        lvl_elems = []
        lvl_coords = []    
        
        for e, ebb, cs in zip(flat_elements, dynamo_element_bboxes, flat_coords):
            if ebb is None: continue
            
            if bbox_intersects_dynamo(ebb, lvbb, tol=tol_mm):
                lvl_elems.append(e)
                lvl_coords.append(cs) 
                
        elements_per_level.append(lvl_elems)
        coords_per_level.append(lvl_coords) 

    # STRUCTURED OUTPUT:
    OUT = [levels, elements_per_level, coords_per_level, level_bboxes]
# ----------------------------------------
code_block_4 = CodeBlock(levels_=ducts_only, elements_=ducts_only) { levels_[0]; elements_[1]; }
id = Element.Id(element=code_block_4.out0)
id_2 = Element.Id(element=firedamper_SelectDuctUI.Levels)
eq = Python(IN[0]=id, IN[1]=id_2)  # CPython3
# ---------- eq.python (16 lines) ----------
import clr

# Data inputs
list_a = IN[0] if isinstance(IN[0], list) else [IN[0]]
list_b = IN[1] if isinstance(IN[1], list) else [IN[1]]

out_list = []

# Check if each ID in list_a exists in list_b
for item in list_a:
    if item in list_b:
        out_list.append(True)
    else:
        out_list.append(False)

OUT = out_list
# ----------------------------------------
filterByBoolMask = List.FilterByBoolMask(list=code_block_4.out1, mask=eq)
if_manually_duct_selecetion = Python(IN[0]=firedamper_SelectDuctUI.Manual_selection, IN[1]=code_block_4.out1, IN[2]=filterByBoolMask.in)  # CPython3
# ---------- if_manually_duct_selecetion.python (34 lines) ----------
# Dynamo Python Node
# IN[0] -> Boolean (True/False) or list of booleans
# IN[1] -> Value if True (scalar, list, nested)
# IN[2] -> Value if False (scalar, list, nested)
# OUT   -> Selected value (scalar or list)

condition = IN[0]
true_val  = IN[1]
false_val = IN[2]

def pick_for_index(container, idx):
    """Return container[idx] if container is a list-like and idx exists,
       otherwise return container itself (scalar or nested)."""
    if isinstance(container, list):
        if idx < len(container):
            return container[idx]
        # index out of range -> fallback to whole container
    return container

def select_by_condition(cond, tval, fval):
    """If cond is a list of booleans, return a list of selections.
       If cond is a single boolean, return the corresponding value directly."""
    # Case: list of booleans -> produce list output
    if isinstance(cond, list):
        out = []
        for i, c in enumerate(cond):
            tv = pick_for_index(tval, i)
            fv = pick_for_index(fval, i)
            out.append(tv if c else fv)
        return out
    # Case: single boolean -> return whole tval or fval (preserve structure)
    return tval if cond else fval

OUT = select_by_condition(condition, true_val, false_val)
# ----------------------------------------
isEmpty = List.IsEmpty(list=if_manually_duct_selecetion@L2)
anyFalse = List.AnyFalse(list=isEmpty@L1)
if_manually_duct_selecetion_2 = Python(IN[0]=firedamper_SelectDuctUI.Manual_selection, IN[1]=anyFalse, IN[2]=eq)  # CPython3; same code as if_manually_duct_selecetion

code_block_5 = CodeBlock(str_=firedamper_SelectDuctUI.ShapeCode) { str_=="None"; }
anyFalse_2 = List.AnyFalse(list=code_block_5)

# group: UI - AR Link
code_block_6 = CodeBlock()
# ---------- code_block_6.designscript (3 lines) ----------
"Select Maximum 1 or 2 Architectural links
(Extra links may slow down the process)";
false;
# ----------------------------------------
selectLink = UI.SelectLink(Run=anyFalse_2, Title=code_block_6.out0)

# group: Rooms as epr duct level and link instances
code_block_7 = CodeBlock { "Rooms"; }
byName = Category.ByName(name=code_block_7)
ofCategory = Revit.LinkElement.OfCategory(linkInstance=selectLink.LinkInstances, category=byName, lacing=CrossProduct)
element = Revit.LinkElement.Element(linkElement=ofCategory)
flatten = List.Flatten(list=element)
count = List.Count(list=element@L2)
cycle = List.Cycle(list=selectLink.LinkTransforms, amount=count, lacing=Shortest)
flatten_2 = List.Flatten(list=cycle)
walls_only = Python(IN[0]=flatten, IN[1]=flatten_2)  # CPython3
# ---------- walls_only.python (220 lines) ----------
# -*- coding: utf-8 -*-
import clr

clr.AddReference('ProtoGeometry')
from Autodesk.DesignScript import Geometry as dg

clr.AddReference('RevitAPI')
from Autodesk.Revit.DB import XYZ, ViewPlan, ViewType, BuiltInParameter, FilteredElementCollector, Plane

clr.AddReference('RevitNodes')
import Revit
clr.ImportExtensions(Revit.Elements)
clr.ImportExtensions(Revit.GeometryConversion) 

clr.AddReference('RevitServices')
from RevitServices.Persistence import DocumentManager

doc = DocumentManager.Instance.CurrentDBDocument

# --------------------------------------------------
# Helpers
# --------------------------------------------------
def is_floor_plan_view(v):
    try:
        if not isinstance(v, ViewPlan): return False
        if v.ViewType != ViewType.FloorPlan: return False
        if hasattr(v, "IsTemplate") and v.IsTemplate: return False
        try:
            dep_param = v.get_Parameter(BuiltInParameter.VIEW_DEPENDENCY)
            if dep_param and dep_param.AsInteger() != 0: return False
        except: pass
        if not hasattr(v, "GenLevel") or v.GenLevel is None: return False
        return True
    except: return False

def bbox_intersects_dynamo(bb_elem, bb_level, tol=0.0):
    """Checks if two Dynamo bounding boxes intersect in 3D space."""
    if bb_elem is None or bb_level is None: return False
    
    e_min, e_max = bb_elem.MinPoint, bb_elem.MaxPoint
    l_min, l_max = bb_level.MinPoint, bb_level.MaxPoint
    
    if (e_max.X + tol < l_min.X) or (e_min.X - tol > l_max.X): return False
    if (e_max.Y + tol < l_min.Y) or (e_min.Y - tol > l_max.Y): return False
    if (e_max.Z + tol < l_min.Z) or (e_min.Z - tol > l_max.Z): return False
    
    return True

def flatten_parallel(items, coords):
    """Recursively flattens nested lists while keeping Elements and CoordinateSystems paired."""
    flat_items = []
    flat_coords = []
    
    if isinstance(items, (list, tuple)):
        # Ensure coords is also a list for safe indexing
        c_list = coords if isinstance(coords, (list, tuple)) else [coords] * len(items)
        
        for i in range(len(items)):
            c_item = c_list[i] if i < len(c_list) else None
            sub_items, sub_coords = flatten_parallel(items[i], c_item)
            flat_items.extend(sub_items)
            flat_coords.extend(sub_coords)
        return flat_items, flat_coords
    else:
        return [items], [coords]

# --------------------------------------------------
# Main
# --------------------------------------------------

raw_elements = UnwrapElement(IN[0])
raw_coords = UnwrapElement(IN[1])

# Flatten the nested lists in perfect synchronization
flat_elements, flat_coords = flatten_parallel(raw_elements, raw_coords)

# --------------------------------------------------
# STEP 1: Get Element BBXs and Transform
# --------------------------------------------------

dynamo_element_bboxes = []

for e, cs in zip(flat_elements, flat_coords):
    if e is None: 
        dynamo_element_bboxes.append(None)
        continue
    try:
        bb = e.get_BoundingBox(None)
        if bb is None: 
            dynamo_element_bboxes.append(None)
            continue

        dyn_bb = bb.ToProtoType()

        if cs is not None and isinstance(cs, dg.CoordinateSystem):
            p_min = dyn_bb.MinPoint
            p_max = dyn_bb.MaxPoint
            
            corners = [
                dg.Point.ByCoordinates(p_min.X, p_min.Y, p_min.Z),
                dg.Point.ByCoordinates(p_min.X, p_min.Y, p_max.Z),
                dg.Point.ByCoordinates(p_min.X, p_max.Y, p_min.Z),
                dg.Point.ByCoordinates(p_min.X, p_max.Y, p_max.Z),
                dg.Point.ByCoordinates(p_max.X, p_min.Y, p_min.Z),
                dg.Point.ByCoordinates(p_max.X, p_min.Y, p_max.Z),
                dg.Point.ByCoordinates(p_max.X, p_max.Y, p_min.Z),
                dg.Point.ByCoordinates(p_max.X, p_max.Y, p_max.Z)
            ]
            
            transformed_pts = [pt.Transform(cs) for pt in corners]
            
            tx = [p.X for p in transformed_pts]
            ty = [p.Y for p in transformed_pts]
            tz = [p.Z for p in transformed_pts]
            
            pmin_new = dg.Point.ByCoordinates(min(tx), min(ty), min(tz))
            pmax_new = dg.Point.ByCoordinates(max(tx), max(ty), max(tz))
            dynamo_element_bboxes.append(dg.BoundingBox.ByCorners(pmin_new, pmax_new))
        else:
            dynamo_element_bboxes.append(dyn_bb)
            
    except:
        dynamo_element_bboxes.append(None)

# --------------------------------------------------
# STEP 2: Create GLOBAL X/Y Limits
# --------------------------------------------------

dyn_xs, dyn_ys = [], []

for dbb in dynamo_element_bboxes:
    if dbb is None: continue
    dyn_xs.extend([dbb.MinPoint.X, dbb.MaxPoint.X])
    dyn_ys.extend([dbb.MinPoint.Y, dbb.MaxPoint.Y])

if not dyn_xs:
    OUT = [[], [], [], "No valid elements found"]
else:
    globalMinX = min(dyn_xs)
    globalMaxX = max(dyn_xs)
    globalMinY = min(dyn_ys)
    globalMaxY = max(dyn_ys)

    # --------------------------------------------------
    # STEP 3: Collect Floor Plan Levels
    # --------------------------------------------------
    all_viewplans = FilteredElementCollector(doc).OfClass(ViewPlan).ToElements()
    floor_plans = [v for v in all_viewplans if is_floor_plan_view(v)]

    level_dict = {}
    for vp in floor_plans:
        try:
            if vp.GenLevel:
                level_dict[vp.GenLevel.Id] = vp.GenLevel
        except: pass

    levels = list(level_dict.values())
    levels.sort(key=lambda l: l.Elevation)

    # --------------------------------------------------
    # STEP 4: Build Level Bounding Boxes (UPDATED GAP LOGIC)
    # --------------------------------------------------
    level_bboxes = []
    
    gap_mm = 50.0 # Creates a 50mm dead zone above and below floors
    default_height_mm = 6000.0

    for i, lvl in enumerate(levels):
        try: elev = lvl.ProjectElevation
        except: elev = lvl.Elevation 
            
        pt_xyz = XYZ(0, 0, elev)
        dyn_plane = Plane.CreateByNormalAndOrigin(XYZ.BasisZ, pt_xyz).ToPlane()
        base_z_mm = dyn_plane.Origin.Z

        # Add the gap to push the bounding box UP from the slab
        zBottom_mm = base_z_mm + gap_mm
        
        if i < len(levels) - 1:
            try: next_elev = levels[i+1].ProjectElevation
            except: next_elev = levels[i+1].Elevation
                
            next_pt = XYZ(0, 0, next_elev)
            next_z_mm = Plane.CreateByNormalAndOrigin(XYZ.BasisZ, next_pt).ToPlane().Origin.Z
            
            # Subtract the gap to pull the bounding box DOWN from the next slab
            zTop_mm = next_z_mm - gap_mm
        else:
            # If it's the top level, apply the default height and still subtract the gap
            zTop_mm = base_z_mm + default_height_mm - gap_mm

        pmin_lvl = dg.Point.ByCoordinates(globalMinX, globalMinY, zBottom_mm)
        pmax_lvl = dg.Point.ByCoordinates(globalMaxX, globalMaxY, zTop_mm)
        
        lvl_bbx = dg.BoundingBox.ByCorners(pmin_lvl, pmax_lvl)
        level_bboxes.append(lvl_bbx)

    # --------------------------------------------------
    # STEP 5: Group Elements & Transforms Per Level
    # --------------------------------------------------
    elements_per_level = []
    coords_per_level = []  
    tol_mm = 1.0 

    for lvbb in level_bboxes:
        lvl_elems = []
        lvl_coords = []    
        
        for e, ebb, cs in zip(flat_elements, dynamo_element_bboxes, flat_coords):
            if ebb is None: continue
            
            if bbox_intersects_dynamo(ebb, lvbb, tol=tol_mm):
                lvl_elems.append(e)
                lvl_coords.append(cs) 
                
        elements_per_level.append(lvl_elems)
        coords_per_level.append(lvl_coords) 

    # STRUCTURED OUTPUT:
    OUT = [levels, elements_per_level, coords_per_level, level_bboxes]
# ----------------------------------------
code_block_8 = CodeBlock(rooms_=walls_only, rooms_cs=walls_only) { rooms_[1]; rooms_cs[2]; }
filterByBoolMask_2 = List.FilterByBoolMask(list=code_block_8.out0, mask=if_manually_duct_selecetion_2)
flatten_3 = List.Flatten(list=filterByBoolMask_2.in)
id_3 = Element.Id(element=filterByBoolMask_2.in)
filterByBoolMask_3 = List.FilterByBoolMask(list=code_block_8.out1, mask=if_manually_duct_selecetion_2)
string_from_object = FromObject(object=filterByBoolMask_3.in)
code_block_9 = CodeBlock(room_id=id_3, room_cs=string_from_object) { room_id+room_cs; }
flatten_4 = List.Flatten(list=code_block_9)
id_4 = Element.Id(element=element)
string_from_object_2 = FromObject(object=cycle)
code_block_10 = CodeBlock(room_id=id_4, room_cs=string_from_object_2) { room_id+room_cs; }
indexOf = List.IndexOf(list=flatten_4, element=code_block_10@@L2)
getItemAtIndex = List.GetItemAtIndex(list=flatten_3, index=indexOf)
cleanParallelData = Lists.CleanParallelData(Data=selectLink.LinkInstances, Guide=getItemAtIndex)

# group: UI - SC Link
code_block_11 = CodeBlock()
# ---------- code_block_11.designscript (3 lines) ----------
"Select Maximum 1 or 2 Structural links
(Extra links may slow down the process)";
false;
# ----------------------------------------
selectLink_2 = UI.SelectLink(Run=selectLink.Run_Succussed, Title=code_block_11.out0)

# group: AR SC walls and AR Rooms
list_create = List.Create(item0=selectLink.LinkInstances, item1=selectLink_2.LinkInstances)
flatten_5 = List.Flatten(list=list_create)
code_block_12 = CodeBlock { "Walls"; }
byName_2 = Category.ByName(name=code_block_12)
ofCategory_2 = Revit.LinkElement.OfCategory(linkInstance=flatten_5, category=byName_2, lacing=CrossProduct)
element_2 = Revit.LinkElement.Element(linkElement=ofCategory_2)

# group: Removing other categories of wall
string_from_object_3 = FromObject(object=element_2)
code_block_13 = CodeBlock(cat_=string_from_object_3) { cat_=="Wall"; }
filterByBoolMask_4 = List.FilterByBoolMask(list=element_2, mask=code_block_13)

# group: UI - Fire damper types, Fire Rating and Room_Function
code_block_14 = CodeBlock { ["Electrical Services","Mechanical Services","MEP","Technical/ MEP Rooms"]; }
fireDamperUI = ScriptUI.FireDamperUI(Run=selectLink_2.Run_Succussed, Walls=filterByBoolMask_4.in, Rooms=cleanParallelData.CleanedGuide, DefaultRooms=code_block_14)

# group: finding room boundary elements
cleanParallelData_2 = Lists.CleanParallelData(Data=cleanParallelData.CleanedData, Guide=fireDamperUI.FilteredRooms)
db_solids = Python(IN[0]=cleanParallelData_2.CleanedGuide, IN[1]=cleanParallelData_2.CleanedData)  # IronPython2
# ---------- db_solids.python (150 lines) ----------
# IN[0] -> Elements (Rooms) - Supports single items or heavily nested lists
# OUT -> Perfectly nested list of Transformed Autodesk.Revit.DB.Solid objects

import clr
import sys

# 1. Import Revit API
clr.AddReference('RevitAPI')
from Autodesk.Revit.DB import *

# 2. Import Document Manager & Core Modules
clr.AddReference('RevitServices')
from RevitServices.Persistence import DocumentManager
from System.Collections.Generic import List

doc = DocumentManager.Instance.CurrentDBDocument

# --- MODULE 1: PRE-PROCESS AND ANCHOR LINK INSTANCES ---
# Gather all link instances in the host document and sort them permanently by ID
all_links = list(FilteredElementCollector(doc).OfClass(RevitLinkInstance))
link_dict = {}

for link in all_links:
    ldoc = link.GetLinkDocument()
    if ldoc:
        title = ldoc.Title
        if title not in link_dict:
            link_dict[title] = []
        link_dict[title].append(link)
        
for title in link_dict:
    link_dict[title].sort(key=lambda x: x.Id.IntegerValue)

# Global tracker to handle identical room IDs across duplicated links
element_counters = {}

# --- MODULE 2: GEOMETRY EXTRACTION UTILITIES ---
def collect_solids_from_geom_element(geomElem):
    sols = []
    if geomElem is None: return sols
    try:
        for go in geomElem:
            if isinstance(go, Solid):
                try: v = go.Volume
                except Exception: v = None
                if v is not None and v > 1e-6:
                    sols.append(go)
            elif isinstance(go, GeometryInstance):
                inst_geom = go.GetInstanceGeometry()
                sols.extend(collect_solids_from_geom_element(inst_geom))
            elif isinstance(go, GeometryElement):
                sols.extend(collect_solids_from_geom_element(go))
    except Exception: pass
    return sols

def get_solids_for_spatial(spatial_el):
    if spatial_el is None: return None
    try: 
        cs = getattr(spatial_el, "ClosedShell", None)
    except Exception: 
        cs = None
    
    if cs is not None:
        sols = collect_solids_from_geom_element(cs)
        if sols: return sols[0] # Return largest/first valid solid
        
    calc = None
    results = None
    try:
        opt = SpatialElementBoundaryOptions()
        # Always use the source document of the room element
        calc = SpatialElementGeometryCalculator(spatial_el.Document, opt)
        results = calc.CalculateSpatialElementGeometry(spatial_el)
        geom = results.GetGeometry()
        sols = collect_solids_from_geom_element(geom)
        
        if sols:
            # Sort to find the largest valid solid volume
            sols.sort(key=lambda s: s.Volume, reverse=True)
            return sols[0]
    except:
        return None
    finally:
        # Crucial: Dispose objects instantly to unlock identical IDs in subsequent links
        if results is not None: results.Dispose()
        if calc is not None: calc.Dispose()
    return None

# --- MODULE 3: THE 1-TO-1 TRACKING ENGINE ---
def process_element_solid(item):
    if item is None: return None
    
    elem = UnwrapElement(item)
    if not hasattr(elem, "Document") or not hasattr(elem, "Id"):
        return None
        
    element_doc = elem.Document
    
    # Extract the raw local solid
    if not isinstance(elem, SpatialElement):
        return None
        
    raw_solid = get_solids_for_spatial(elem)
    if raw_solid is None:
        return None
        
    # If the element belongs to the host model, no transformation is needed
    if element_doc.Equals(doc):
        return raw_solid
        
    # Process linked element via the Mathematical 1-to-1 Mapping loop
    doc_title = element_doc.Title
    element_id = elem.Id.IntegerValue
    element_key = (doc_title, element_id)
    
    if element_key not in element_counters:
        element_counters[element_key] = 0
        
    current_count = element_counters[element_key]
    available_links = link_dict.get(doc_title, [])
    
    if not available_links:
        return raw_solid
    else:
        # Step through link instances incrementally using the persistent counter
        assigned_link = available_links[current_count % len(available_links)]
        revit_transform = assigned_link.GetTotalTransform()
        
        # Transform the pure DB Solid object into real-world host space
        if not revit_transform.IsIdentity:
            try:
                transformed_solid = SolidUtils.CreateTransformed(raw_solid, revit_transform)
                if transformed_solid is not None:
                    raw_solid = transformed_solid
            except:
                pass
                
        # Increment the counter explicitly for the next loop iteration
        element_counters[element_key] += 1
        return raw_solid

# --- MODULE 4: RECURSIVE DATA TREE PRESERVATION ---
def process_nested_lists(item):
    if isinstance(item, list):
        return [process_nested_lists(x) for x in item]
    else:
        return process_element_solid(item)

# Run the execution mapping across your exact input tree
OUT = process_nested_lists(IN[0])
# ----------------------------------------
bottom_faces = Python(IN[0]=db_solids)  # CPython3
# ---------- bottom_faces.python (48 lines) ----------
import clr

# Import Revit API
clr.AddReference('RevitAPI')
from Autodesk.Revit.DB import Solid, PlanarFace

# --- INPUT ---
# Input can be a single solid, a flat list, or a heavily nested list
solids_in = IN[0]

# --- CORE LOGIC ---
def get_bottom_face(item):
    
    # 1. Handle Nested Lists (Recursion)
    if isinstance(item, list):
        return [get_bottom_face(x) for x in item]
        
    # 2. Handle the Solid
    elif isinstance(item, Solid):
        bottom_faces = []
        
        # Iterate all faces in the solid
        for face in item.Faces:
            if isinstance(face, PlanarFace):
                try:
                    # Check if the normal points downwards
                    if face.FaceNormal.Z < -0.99:
                        bottom_faces.append(face)
                except:
                    pass
        
        # 3. 1-to-1 Mapping Logic
        if len(bottom_faces) == 1:
            return bottom_faces[0]
        elif len(bottom_faces) > 1:
            # If a complex room generates multiple bottom faces, return the largest one
            bottom_faces.sort(key=lambda f: f.Area, reverse=True)
            return bottom_faces[0]
        else:
            # Returns None if the solid has no bottom face
            return None
            
    # 3. Handle nulls or invalid inputs
    else:
        return None

# --- OUTPUT ---
OUT = get_bottom_face(solids_in)
# ----------------------------------------
perimeter_curves = Python(IN[0]=bottom_faces)  # CPython3
# ---------- perimeter_curves.python (43 lines) ----------
import clr

# Import Revit API
clr.AddReference('RevitAPI')
from Autodesk.Revit.DB import *

# Import Dynamo Geometry Conversion capabilities
clr.AddReference('RevitNodes')
import Revit
clr.ImportExtensions(Revit.GeometryConversion)

# The input data (can be a single item, a list, or a deeply nested list)
input_data = IN[0]

# Recursive function to preserve exact list structure
def get_curves_from_faces(item):
    # If the item is a list, dive deeper and process its contents
    if isinstance(item, list):
        return [get_curves_from_faces(x) for x in item]
    
    # If it's not a list, assume it's a Face and extract curves
    else:
        face_loops = []
        try:
            # Extract the boundary loops from the Revit face
            curve_loops = item.GetEdgesAsCurveLoops()
            
            for loop in curve_loops:
                loop_curves = []
                for curve in loop:
                    # Convert Revit DB Curve to Dynamo Curve
                    loop_curves.append(curve.ToProtoType())
                
                # Append the closed loop to the face's list
                face_loops.append(loop_curves)
        except:
            # If it fails or is null, return an empty list to maintain index mapping
            pass
            
        return face_loops

# Run the function and output the structured lists
OUT = get_curves_from_faces(input_data)
# ----------------------------------------
surounding_elements = Python(IN[0]=perimeter_curves, IN[1]=flatten_5)  # CPython3
# ---------- surounding_elements.python (169 lines) ----------
import clr
import sys

# 1. Import Revit API
clr.AddReference('RevitAPI')
from Autodesk.Revit.DB import *

# 2. Import Dynamo Geometry & Element Wrapper
clr.AddReference("RevitNodes")
import Revit
clr.ImportExtensions(Revit.GeometryConversion)
clr.ImportExtensions(Revit.Elements)

# 3. Import Document Manager & Collections
clr.AddReference('RevitServices')
from RevitServices.Persistence import DocumentManager
from System.Collections.Generic import List

# --- INPUTS ---
dynamo_curves = IN[0]
raw_links_input = UnwrapElement(IN[1])

host_doc = DocumentManager.Instance.CurrentDBDocument

# --- MODULE 1: Bulletproof Link Extractor ---
def get_links(items):
    links = []
    if items is None: return links
    if isinstance(items, list):
        for i in items: links.extend(get_links(i))
    else:
        if isinstance(items, RevitLinkInstance): links.append(items)
    return links

flat_links = get_links(raw_links_input)

# --- MODULE 2: Coordinate Space & Transform Tracking ---
# Convert Revit Identity Transform to a Dynamo CoordinateSystem for the Host
host_cs = Transform.Identity.ToCoordinateSystem()
search_targets = [(host_doc, Transform.Identity, host_cs)]

for link in flat_links:
    link_doc = link.GetLinkDocument()
    if link_doc is not None:
        total_transform = link.GetTotalTransform()
        inv_transform = total_transform.Inverse
        
        # Convert Link Transform to a Dynamo CoordinateSystem
        link_cs = total_transform.ToCoordinateSystem()
        search_targets.append((link_doc, inv_transform, link_cs))

# --- MODULE 3: Metric Tolerances ---
Z_SHIFT_MM = 600.0     
BOX_HEIGHT_MM = 650.0  

SEARCH_RADIUS_MM = 25.0  
MAX_CENTERLINE_DIST_MM = 1000.0 

def mm_to_ft(mm): return mm / 304.8

bboxVec = XYZ(mm_to_ft(SEARCH_RADIUS_MM), mm_to_ft(SEARCH_RADIUS_MM), mm_to_ft(BOX_HEIGHT_MM))
z_shift_vec = XYZ(0, 0, mm_to_ft(Z_SHIFT_MM))

# Category Filters
bics = [BuiltInCategory.OST_Walls, BuiltInCategory.OST_StructuralColumns, BuiltInCategory.OST_Columns, BuiltInCategory.OST_RoomSeparationLines]
bicCol = List[BuiltInCategory](bics)
catFilter = ElementMulticategoryFilter(bicCol)

# --- MODULE 4: Core Intersection & Verification Logic ---
def get_bounding_element(dynamo_curve):
    try:
        if dynamo_curve.__class__.__name__ == "PolyCurve":
            return "ERROR: Explode PolyCurve into lines first.", None
            
        revit_curve = dynamo_curve.ToRevitType()
        host_midpoint = revit_curve.ComputeDerivatives(0.5, True).Origin.Add(z_shift_vec)
        boundary_dir = revit_curve.ComputeDerivatives(0.5, True).BasisX.Normalize()
        
        # Unpack the dynamo_cs here
        for doc, inv_transform, dynamo_cs in search_targets:
            local_midpoint = inv_transform.OfPoint(host_midpoint)
            local_boundary_dir = inv_transform.OfVector(boundary_dir)
            
            bbox = BoundingBoxXYZ()
            bbox.Min = local_midpoint.Subtract(bboxVec)
            bbox.Max = local_midpoint.Add(bboxVec)
            bboxFilter = BoundingBoxIntersectsFilter(Outline(bbox.Min, bbox.Max))
            
            collector = FilteredElementCollector(doc)
            results = collector.WherePasses(bboxFilter).WherePasses(catFilter).ToElements()
            
            if len(results) > 0:
                best_elem = None
                min_dist = 1000000.0 
                
                for elem in results:
                    try:
                        loc = elem.Location
                        cat_id = elem.Category.Id.IntegerValue
                        is_column = (cat_id == int(BuiltInCategory.OST_StructuralColumns) or cat_id == int(BuiltInCategory.OST_Columns))
                        
                        if isinstance(loc, LocationCurve):
                            curve = loc.Curve
                            projected = curve.Project(local_midpoint)
                            
                            if projected is not None:
                                if projected.Distance <= mm_to_ft(MAX_CENTERLINE_DIST_MM):
                                    if is_column:
                                        if projected.Distance < min_dist:
                                            min_dist = projected.Distance
                                            best_elem = elem
                                    else:
                                        touch_param = projected.Parameter
                                        elem_dir = curve.ComputeDerivatives(touch_param, False).BasisX.Normalize()
                                        dot = abs(local_boundary_dir.DotProduct(elem_dir))
                                        
                                        if dot > 0.95:
                                            if projected.Distance < min_dist:
                                                min_dist = projected.Distance
                                                best_elem = elem
                                                
                        elif isinstance(loc, LocationPoint):
                            pt = loc.Point
                            pt_flat = XYZ(pt.X, pt.Y, local_midpoint.Z)
                            dist = pt_flat.DistanceTo(local_midpoint)
                            
                            if dist <= mm_to_ft(MAX_CENTERLINE_DIST_MM):
                                if dist < min_dist:
                                    min_dist = dist
                                    best_elem = elem
                    except:
                        pass
                        
                if best_elem is not None:
                    try: 
                        # Return the Dynamo CoordinateSystem instead of the link instance
                        return best_elem.ToDSType(False), dynamo_cs
                    except: 
                        return "Linked Element: " + best_elem.Name, dynamo_cs
                        
        return None, None
        
    except Exception as e:
        return "PYTHON ERROR: " + str(e), None

# --- MODULE 5: Data Structure Processing ---
def process_data(item):
    if isinstance(item, list): 
        return [process_data(x) for x in item]
    else: 
        elem, cs = get_bounding_element(item)
        return (item, elem, cs)

raw_tree = process_data(dynamo_curves)

def extract_layer(tree, index):
    if isinstance(tree, tuple): 
        return tree[index]
    elif isinstance(tree, list): 
        return [extract_layer(x, index) for x in tree]
    else: 
        return tree

# --- OUTPUT ---
OUT = [
    extract_layer(raw_tree, 0), 
    extract_layer(raw_tree, 1), 
    extract_layer(raw_tree, 2)
]
# ----------------------------------------
code_block_15 = CodeBlock(BOUNDARY_=surounding_elements, BOUNDARY_ELEMENTS=surounding_elements, LINKS_TRANSFORM=surounding_elements) { BOUNDARY_[0]; BOUNDARY_ELEMENTS[1]; LINKS_TRANSFORM[2]; }
BOUNDARY = List.Flatten(list=code_block_15.out0@L3)
BOUNDARY_ELEMENTS = List.Flatten(list=code_block_15.out1@L3)
cleanParallelData_3 = Lists.CleanParallelData(Data=BOUNDARY, Guide=BOUNDARY_ELEMENTS)
LINKS_TRANSFORM = List.Flatten(list=code_block_15.out2@L3)
cleanParallelData_4 = Lists.CleanParallelData(Data=LINKS_TRANSFORM, Guide=BOUNDARY_ELEMENTS)
code_block_16 = CodeBlock(ROOMS=cleanParallelData_2.CleanedGuide) { ROOMS; }
flatten_6 = List.Flatten(list=code_block_16)
cleanParallelData_5 = Lists.CleanParallelData(Data=flatten_6, Guide=BOUNDARY_ELEMENTS)

# group: Room.Boundary and walls
string_from_object_4 = FromObject(object=cleanParallelData_3.CleanedGuide)
code_block_17 = CodeBlock(CAT_=string_from_object_4) { CAT_=="Wall"; }
filterByBoolMask_5 = List.FilterByBoolMask(list=cleanParallelData_3.CleanedData, mask=code_block_17)
filterByBoolMask_6 = List.FilterByBoolMask(list=cleanParallelData_3.CleanedGuide, mask=code_block_17)
cleanParallelData_6 = Lists.CleanParallelData(Data=filterByBoolMask_5.in, Guide=filterByBoolMask_6.in)
getLocation = Element.GetLocation(element=cleanParallelData_6.CleanedGuide)
filterByBoolMask_7 = List.FilterByBoolMask(list=cleanParallelData_4.CleanedData, mask=code_block_17)
cleanParallelData_7 = Lists.CleanParallelData(Data=filterByBoolMask_7.in, Guide=filterByBoolMask_6.in)
transform = Geometry.Transform(geometry=getLocation, cs=cleanParallelData_7.CleanedData)
code_block_18 = CodeBlock(lines_=transform) { lines_; }
code_block_19 = CodeBlock(lines_=cleanParallelData_6.CleanedData) { lines_; }
code_block_20 = CodeBlock { 0.5; }
pointAtParameter = Curve.PointAtParameter(curve=code_block_18, param=code_block_20)
byOriginNormal = Plane.ByOriginNormal(origin=pointAtParameter)
pullOntoPlane = Curve.PullOntoPlane(curve=code_block_19, plane=byOriginNormal)
pulling_wall_curve_on_room = Python(IN[0]=code_block_18, IN[1]=pullOntoPlane)  # "PULLING WALL CURVE ON ROOM BOUNDARY"; CPython3
# ---------- pulling_wall_curve_on_room.python (67 lines) ----------
import clr

# Import Dynamo ProtoGeometry for native curve manipulation
clr.AddReference('ProtoGeometry')
from Autodesk.DesignScript.Geometry import *

inner_curves = IN[0]
outer_curves = IN[1]

def project_and_trim(inner_c, outer_c):
    if inner_c is None or outer_c is None:
        return None
        
    try:
        # 1. Project Outer Endpoints onto Inner Curve
        # ClosestPointTo automatically stops at the ends of the inner curve (perfect for the Red/Yellow lines)
        pt1 = inner_c.ClosestPointTo(outer_c.StartPoint)
        pt2 = inner_c.ClosestPointTo(outer_c.EndPoint)
        
        # 2. Get the 0.0 to 1.0 parameters of those projected points
        t1 = inner_c.ParameterAtPoint(pt1)
        t2 = inner_c.ParameterAtPoint(pt2)
        
        # 3. Ensure we draw in the correct direction (preserves the room boundary loop direction)
        t_min = min(t1, t2)
        t_max = max(t1, t2)
        
        # If the points land on the exact same spot, it's a perpendicular miss. Skip it.
        if t_max - t_min < 0.001:
            return None 
            
        # 4. Reconstruct the trimmed curve natively exactly on the inner boundary
        curve_type = inner_c.__class__.__name__
        
        if curve_type == "Line":
            p_start = inner_c.PointAtParameter(t_min)
            p_end = inner_c.PointAtParameter(t_max)
            return Line.ByStartPointEndPoint(p_start, p_end)
            
        elif curve_type == "Arc":
            p_start = inner_c.PointAtParameter(t_min)
            # Find the middle of the trimmed arc to ensure it curves correctly
            p_mid = inner_c.PointAtParameter((t_min + t_max) / 2.0)
            p_end = inner_c.PointAtParameter(t_max)
            return Arc.ByThreePoints(p_start, p_mid, p_end)
            
        else:
            # Fallback for complex splines
            return inner_c
            
    except Exception as e:
        return "PYTHON ERROR: " + str(e)

# Recursive engine to perfectly maintain your deeply nested list structures
def process_lists(inner, outer):
    if isinstance(inner, list) and isinstance(outer, list):
        length = min(len(inner), len(outer))
        return [process_lists(inner[i], outer[i]) for i in range(length)]
    elif isinstance(inner, list):
        return [process_lists(x, outer) for x in inner]
    elif isinstance(outer, list):
        return [process_lists(inner, x) for x in outer]
    else:
        return project_and_trim(inner, outer)

# Run the script
OUT = process_lists(inner_curves, outer_curves)
# ----------------------------------------
cleanParallelData_8 = Lists.CleanParallelData(Data=cleanParallelData_6.CleanedGuide, Guide=pulling_wall_curve_on_room)
cleanParallelData_9 = Lists.CleanParallelData(Data=cleanParallelData_7.CleanedData, Guide=pulling_wall_curve_on_room)
anyTrue = List.AnyTrue(list=code_block_17@L2)

# group: Fire rated walls and its transform
code_block_21 = CodeBlock(walls_=fireDamperUI.FilteredWalls) { walls_; }
code_block_22 = CodeBlock(AR_TRAS_=selectLink.LinkTransforms) { AR_TRAS_; }
code_block_23 = CodeBlock(SC_TRAS_=selectLink_2.LinkTransforms) { SC_TRAS_; }
join_2 = List.Join(list0=code_block_22, list1=code_block_23)
count_2 = List.Count(list=code_block_21@L2)
cycle_2 = List.Cycle(list=join_2, amount=count_2, lacing=Shortest)

# group: 1. Grouping Revit model elements by their actual physical level location, (not just by Reference Level) (For level bounding boxes - If distance between two consecutive levels is less than 1000 mm, ignore the upper level and use the next valid one.)
code_block_24 = CodeBlock(DUCTS_=ducts_only) { DUCTS_; }
code_block_25 = CodeBlock(levels_=code_block_24, elements_=code_block_24) { levels_[0]; elements_[1]; }
join_3 = List.Join(list0=cleanParallelData_8.CleanedData, list1=code_block_21)
flatten_7 = List.Flatten(list=join_3)
join_4 = List.Join(list0=cleanParallelData_9.CleanedData, list1=cycle_2)
flatten_8 = List.Flatten(list=join_4)
walls_only_2 = Python(IN[0]=flatten_7, IN[1]=flatten_8)  # CPython3; same code as walls_only
code_block_26 = CodeBlock(levels_=walls_only_2, elements_=walls_only_2, elements_CS=walls_only_2) { levels_[0]; elements_[1]; elements_CS[2]; }

# group: Getting level elements which have both ducts and walls
list_create_2 = List.Create(item0=code_block_25.out1, item1=code_block_26.out1, item2=code_block_26.out2)
transpose = List.Transpose(lists=list_create_2@L4)
code_block_27 = CodeBlock(LIST_=transpose) { LIST_[0]; }
isEmpty_2 = List.IsEmpty(list=code_block_27@@L2)
anyTrue_2 = List.AnyTrue(list=isEmpty_2@L2)
filterByBoolMask_8 = List.FilterByBoolMask(list=code_block_27, mask=anyTrue_2)
id_5 = Element.Id(element=code_block_25.out0)
id_6 = Element.Id(element=firedamper_SelectDuctUI.Levels)
eq_2 = Python(IN[0]=id_5, IN[1]=id_6)  # CPython3; same code as eq
filterByBoolMask_9 = List.FilterByBoolMask(list=code_block_27, mask=eq_2)
isEmpty_3 = List.IsEmpty(list=filterByBoolMask_9.in@@L2)
anyTrue_3 = List.AnyTrue(list=isEmpty_3@L2)
filterByBoolMask_10 = List.FilterByBoolMask(list=filterByBoolMask_9.in, mask=anyTrue_3)
if_manually_duct_selecetion_3 = Python(IN[0]=firedamper_SelectDuctUI.Manual_selection, IN[1]=filterByBoolMask_8.out, IN[2]=filterByBoolMask_10.out)  # CPython3; same code as if_manually_duct_selecetion
code_block_28 = CodeBlock { 0; 1; 2; }
DUCTS = List.GetItemAtIndex(list=if_manually_duct_selecetion_3@@L3, index=code_block_28.out0)
WALLS = List.GetItemAtIndex(list=if_manually_duct_selecetion_3@@L3, index=code_block_28.out1)
walls_cs = List.GetItemAtIndex(list=if_manually_duct_selecetion_3@@L3, index=code_block_28.out2)

code_block_29 = CodeBlock(ducts_=DUCTS) { ducts_; }
boundingBox = Element.BoundingBox(element=code_block_29)

# group: Unique walls
id_7 = Element.Id(element=WALLS)
string_from_object_5 = FromObject(object=walls_cs)
code_block_30 = CodeBlock(WALL_ID=id_7, WALL_CS=string_from_object_5) { WALL_ID+WALL_CS; }
uniqueItems = List.UniqueItems(list=code_block_30@L2)
indexOf_2 = List.IndexOf(list=code_block_30@L2, element=uniqueItems@L2)
getItemAtIndex_2 = List.GetItemAtIndex(list=WALLS@L2, index=indexOf_2@L2)
getItemAtIndex_3 = List.GetItemAtIndex(list=walls_cs@L2, index=indexOf_2@L2)

# group: Transforming the bounding boxes of linked wall
code_block_31 = CodeBlock(walls_=getItemAtIndex_2, WALL_CS=getItemAtIndex_3) { walls_; WALL_CS; }
boundingBox_2 = Element.BoundingBox(element=code_block_31.walls_)
minPoint = BoundingBox.MinPoint(boundingBox=boundingBox_2)
transform_2 = Geometry.Transform(geometry=minPoint, cs=code_block_31.WALL_CS, lacing=Shortest)
maxPoint = BoundingBox.MaxPoint(boundingBox=boundingBox_2)
transform_3 = Geometry.Transform(geometry=maxPoint, cs=code_block_31.WALL_CS, lacing=Shortest)
byCorners = BoundingBox.ByCorners(min=transform_2, max=transform_3)

# group: 2. Grouping elements by bounding box clashes
code_block_32 = CodeBlock(boundingBox1=boundingBox, boundingBox2=byCorners) { bool1 = Autodesk.BoundingBox.Intersects(boundingBox1<1>, boundingBox2<1><2>); }
code_block_33 = CodeBlock(t1=code_block_29, bool1=code_block_32)
# ---------- code_block_33.designscript (3 lines) ----------
t2 = List.FilterByBoolMask(t1<1>, bool1<1><2>);
t3 = Dictionary.ValueAtKey(t2, "in");
t4 = Dictionary.ValueAtKey(t2, "out");
# ----------------------------------------
code_block_34 = CodeBlock(ducts_=code_block_33.t3) { ducts_; }
isEmpty_4 = List.IsEmpty(list=code_block_33.t3@@L2)
filterByBoolMask_11 = List.FilterByBoolMask(list=code_block_34, mask=isEmpty_4)
code_block_35 = CodeBlock(ducts_=filterByBoolMask_11.out) { ducts_; }
filterByBoolMask_12 = List.FilterByBoolMask(list=code_block_31.walls_, mask=isEmpty_4)
code_block_36 = CodeBlock(walls_=filterByBoolMask_12.out) { walls_; }
filterByBoolMask_13 = List.FilterByBoolMask(list=code_block_31.WALL_CS, mask=isEmpty_4)
code_block_37 = CodeBlock(walls_CS=filterByBoolMask_13.out) { walls_CS; }

# group: Filtering out ducts which are parallel to wall
getLocation_2 = Element.GetLocation(element=code_block_36)
transform_4 = Geometry.Transform(geometry=getLocation_2, cs=code_block_37, lacing=Shortest)
direction = Line.Direction(line=transform_4)
get_location = Python(IN[0]=code_block_35)  # CPython3
# ---------- get_location.python (124 lines) ----------
# -*- coding: utf-8 -*-
import clr

clr.AddReference('ProtoGeometry')
from Autodesk.DesignScript import Geometry as dg

clr.AddReference('RevitAPI')
from Autodesk.Revit.DB import XYZ, FamilyInstance, BuiltInCategory
from Autodesk.Revit.DB.Mechanical import Duct

clr.AddReference('RevitNodes')
import Revit
clr.ImportExtensions(Revit.Elements)
clr.ImportExtensions(Revit.GeometryConversion)

# Extension length: 200mm each way (400mm total centerline)
EXT_LEN_FT = 200.0 / 304.8
FEET_TO_MM = 304.8 # Added multiplier to fix the Dynamo workspace scale

def get_vector_line_or_curve(item):
    if item is None: 
        return None
        
    # Pass text/metadata strings or numbers through completely untouched
    if isinstance(item, (str, int, float, bool)):
        return item
        
    try:
        elem = UnwrapElement(item)
        if not elem or not hasattr(elem, "IsValidObject") or not elem.IsValidObject:
            return item
            
        # --- SCENARIO 1: RIGID DUCT ---
        if isinstance(elem, Duct):
            try:
                # ToProtoType() automatically scales feet to your workspace mm
                return elem.Location.Curve.ToProtoType()
            except:
                pass 
                
        # --- SCENARIO 2: AIR TERMINALS & FAMILY INSTANCES ---
        cat_id = elem.Category.Id.IntegerValue if elem.Category else 0
        is_terminal = (cat_id == int(BuiltInCategory.OST_DuctTerminal))
        
        if isinstance(elem, FamilyInstance) or is_terminal:
            
            # 1. IRONCLAD ORIGIN EXTRACTION
            origin = None
            try:
                if elem.Location and hasattr(elem.Location, "Point"):
                    origin = elem.Location.Point
            except: pass
            
            if not origin:
                try: origin = elem.GetTransform().Origin
                except: pass
                
            if not origin:
                try:
                    bb = elem.get_BoundingBox(None)
                    # CPython3 safe division
                    if bb: 
                        origin = XYZ((bb.Min.X + bb.Max.X)/2.0, (bb.Min.Y + bb.Max.Y)/2.0, (bb.Min.Z + bb.Max.Z)/2.0)
                except: pass
                
            # 2. IRONCLAD VECTOR EXTRACTION
            if origin:
                vec_dir = None
                
                try:
                    if hasattr(elem, "MEPModel") and elem.MEPModel and elem.MEPModel.ConnectorManager:
                        for conn in elem.MEPModel.ConnectorManager.Connectors:
                            try: vec_dir = conn.CoordinateSystem.BasisZ
                            except: pass
                            
                            if not vec_dir or vec_dir.IsAlmostEqualTo(XYZ.Zero):
                                try: vec_dir = conn.Direction
                                except: pass
                                
                            if vec_dir and not vec_dir.IsAlmostEqualTo(XYZ.Zero):
                                break
                except: pass
                
                if not vec_dir or vec_dir.IsAlmostEqualTo(XYZ.Zero):
                    try: vec_dir = elem.FacingOrientation
                    except: pass
                    
                if not vec_dir or vec_dir.IsAlmostEqualTo(XYZ.Zero):
                    try: vec_dir = elem.GetTransform().BasisZ
                    except: pass
                    
                if not vec_dir or vec_dir.IsAlmostEqualTo(XYZ.Zero):
                    vec_dir = XYZ.BasisZ 
                    
                # 3. GENERATE THE LINE (With explicit Metric conversion)
                try:
                    norm_dir = vec_dir.Normalize()
                    
                    # Math in Revit's internal Feet
                    offset_vec = norm_dir.Multiply(EXT_LEN_FT)
                    pt_forward = origin.Add(offset_vec)
                    pt_reverse = origin.Subtract(offset_vec)
                    
                    # SCALE FIX: Convert feet back to mm for Dynamo
                    p_start = dg.Point.ByCoordinates(pt_reverse.X * FEET_TO_MM, pt_reverse.Y * FEET_TO_MM, pt_reverse.Z * FEET_TO_MM)
                    p_end = dg.Point.ByCoordinates(pt_forward.X * FEET_TO_MM, pt_forward.Y * FEET_TO_MM, pt_forward.Z * FEET_TO_MM)
                    
                    return dg.Line.ByStartPointEndPoint(p_start, p_end)
                except Exception as e:
                    return "PYTHON MATH ERROR: " + str(e)
                    
        return item
    except:
        return item

# Recursive Data Tree engine
def process_data_tree(data):
    if isinstance(data, (list, tuple)):
        return [process_data_tree(x) for x in data]
    else:
        return get_vector_line_or_curve(data)

# --- Main Execution ---
OUT = process_data_tree(IN[0])
# ----------------------------------------
direction_2 = Line.Direction(line=get_location)
angleWithVector = Vector.AngleWithVector(vector=direction@@L1, otherVector=direction_2@L2)
code_block_38 = CodeBlock(ANGLE_=angleWithVector) { ANGLE_<20 || ANGLE_>160; }

code_block_39 = CodeBlock { false; }
replaceNull = archilab.Lists.Lists.ReplaceNull(list=code_block_38, replacement=code_block_39)

# group (continued): Filtering out ducts which are parallel to wall
filterByBoolMask_14 = List.FilterByBoolMask(list=code_block_35, mask=replaceNull)
isEmpty_5 = List.IsEmpty(list=filterByBoolMask_14.out@@L2)
filterByBoolMask_15 = List.FilterByBoolMask(list=filterByBoolMask_14.out, mask=isEmpty_5)
allTrue = List.AllTrue(list=replaceNull@@L2)
filterByBoolMask_16 = List.FilterByBoolMask(list=code_block_36, mask=allTrue)
isEmpty_6 = List.IsEmpty(list=filterByBoolMask_16.out@@L2)
filterByBoolMask_17 = List.FilterByBoolMask(list=filterByBoolMask_16.out, mask=isEmpty_6)
filterByBoolMask_18 = List.FilterByBoolMask(list=code_block_37, mask=allTrue)
filterByBoolMask_19 = List.FilterByBoolMask(list=filterByBoolMask_18.out, mask=isEmpty_6)

code_block_40 = CodeBlock(ducts_=filterByBoolMask_15.out) { ducts_; }
flatten_9 = List.Flatten(list=code_block_40@L2)

# group: Creating unique name for each duplicated elements of Duplicated link instances
flatten_10 = List.Flatten(list=cleanParallelData_8.CleanedGuide)
flatten_11 = List.Flatten(list=cleanParallelData_8.CleanedData)
id_8 = Element.Id(element=flatten_11)
flatten_12 = List.Flatten(list=cleanParallelData_9.CleanedData)
string_from_object_6 = FromObject(object=flatten_12)
code_block_41 = CodeBlock(ID_=id_8, CS_=string_from_object_6) { ID_+CS_; }

code_block_42 = CodeBlock(walls_=filterByBoolMask_17.out) { walls_; }
flatten_13 = List.Flatten(list=code_block_42)
code_block_43 = CodeBlock(walls_CS=filterByBoolMask_19.out) { walls_CS; }
flatten_14 = List.Flatten(list=code_block_43)

# group: Considering wall profile clashes and getting point on duct location curve if duct is clashing with wall partially (all Room_functionan and Fire rated walls)
old_offseting_duct_location_in_8 = Python(IN[0]=flatten_9)  # "old offseting duct location in 8 directions"; CPython3
# ---------- old_offseting_duct_location_in_8.python (88 lines) ----------
import clr
import math

# Load Revit API
clr.AddReference('RevitAPI')
from Autodesk.Revit.DB import *

# Load RevitNodes for Dynamo conversion
clr.AddReference('RevitNodes')
import Revit
clr.ImportExtensions(Revit.GeometryConversion)

def get_offset_lines(duct):
    """Processes a single duct and returns 9 lines (Center + 8 Perimeter)."""
    try:
        # Unwrap the element to access Revit API
        d = UnwrapElement(duct)
        loc_curve = d.Location.Curve
        p0 = loc_curve.GetEndPoint(0)
        p1 = loc_curve.GetEndPoint(1)
        
        # Vector Math using explicit methods from reference code
        direction = p1.Subtract(p0).Normalize()
        
        # Determine orientation
        is_vertical = abs(direction.Z) > 0.99
        ref_vec = XYZ.BasisX if is_vertical else XYZ.BasisZ
        
        side_vec = direction.CrossProduct(ref_vec).Normalize()
        up_vec = side_vec.CrossProduct(direction).Normalize()

        shape = d.DuctType.Shape
        lines = []
        
        # 1. Add Center Line (Standard)
        lines.append(loc_curve.ToProtoType())

        if shape == ConnectorProfileType.Round:
            radius = d.Diameter / 2.0
            # 8 Points around the circle (45 deg intervals)
            for i in range(8):
                angle = i * (math.pi / 4)
                # Radial offset vector calculation
                h_comp = side_vec.Multiply(math.cos(angle))
                v_comp = up_vec.Multiply(math.sin(angle))
                offset_vec = h_comp.Add(v_comp).Multiply(radius)
                
                trans = Transform.CreateTranslation(offset_vec)
                lines.append(loc_curve.CreateTransformed(trans).ToProtoType())
        
        else:
            w_off = d.Width / 2.0
            h_off = d.Height / 2.0
            
            # Define 8 Offset Vectors for Rectangular Perimeter
            # T, B, L, R + 4 Corners
            offsets = [
                up_vec.Multiply(h_off), # Top
                up_vec.Multiply(-h_off), # Bottom
                side_vec.Multiply(w_off), # Left
                side_vec.Multiply(-w_off), # Right
                up_vec.Multiply(h_off).Add(side_vec.Multiply(w_off)), # TL
                up_vec.Multiply(h_off).Add(side_vec.Multiply(-w_off)), # TR
                up_vec.Multiply(-h_off).Add(side_vec.Multiply(w_off)), # BL
                up_vec.Multiply(-h_off).Add(side_vec.Multiply(-w_off)) # BR
            ]
            
            for vec in offsets:
                trans = Transform.CreateTranslation(vec)
                lines.append(loc_curve.CreateTransformed(trans).ToProtoType())

        return lines
    except:
        return None

def process_list(input_list):
    """Recursively processes lists to handle any depth."""
    output = []
    for item in input_list:
        if isinstance(item, list):
            output.append(process_list(item))
        else:
            output.append(get_offset_lines(item))
    return output

# --- INPUT HANDLING ---
data_in = IN[0] if isinstance(IN[0], list) else [IN[0]]
OUT = process_list(data_in)
# ----------------------------------------
geometry = Element.Geometry(element=flatten_13)
byUnion = Solid.ByUnion(solids=geometry@L2)
transform_5 = Geometry.Transform(geometry=byUnion, cs=flatten_14)
offseting_duct_location_in_8 = Python(IN[0]=flatten_9)  # "offseting duct location in 8 directions"; CPython3
# ---------- offseting_duct_location_in_8.python (182 lines) ----------
# -*- coding: utf-8 -*-
import clr
import math

clr.AddReference('ProtoGeometry')
from Autodesk.DesignScript import Geometry as dg

clr.AddReference('RevitAPI')
from Autodesk.Revit.DB import *
from Autodesk.Revit.DB.Mechanical import Duct

clr.AddReference('RevitNodes')
import Revit
clr.ImportExtensions(Revit.Elements)
clr.ImportExtensions(Revit.GeometryConversion)

# 200mm each way (400mm total centerline for Air Terminals)
EXT_LEN_FT = 200.0 / 304.8

def get_offset_lines(item):
    """Processes Ducts and Air Terminals and returns 9 lines (Center + 8 Perimeter)."""
    if item is None: return None
    
    # Pass metadata strings or numbers through untouched
    if isinstance(item, (str, int, float, bool)):
        return item
        
    try:
        elem = UnwrapElement(item)
        if not elem or not hasattr(elem, "IsValidObject") or not elem.IsValidObject:
            return item

        # --- STEP 1: EXTRACT CURVE AND DIMENSIONS ---
        loc_curve = None
        shape = None
        width = 0.0
        height = 0.0
        radius = 0.0

        # SCENARIO A: DUCT
        if isinstance(elem, Duct):
            loc_curve = elem.Location.Curve
            shape = elem.DuctType.Shape
            if shape == ConnectorProfileType.Round:
                radius = elem.Diameter / 2.0
            else:
                width = elem.Width
                height = elem.Height

        # SCENARIO B: AIR TERMINAL
        elif isinstance(elem, FamilyInstance) or (elem.Category and elem.Category.Id.IntegerValue == int(BuiltInCategory.OST_DuctTerminal)):
            
            # 1. Ironclad Origin
            origin = None
            try:
                if elem.Location and hasattr(elem.Location, "Point"): origin = elem.Location.Point
            except: pass
            
            if not origin:
                try: origin = elem.GetTransform().Origin
                except: pass
                
            if not origin:
                try:
                    bb = elem.get_BoundingBox(None)
                    if bb: origin = XYZ((bb.Min.X + bb.Max.X)/2.0, (bb.Min.Y + bb.Max.Y)/2.0, (bb.Min.Z + bb.Max.Z)/2.0)
                except: pass

            # 2. Ironclad Vector & Size Extraction
            vec_dir = None
            if origin:
                try:
                    if hasattr(elem, "MEPModel") and elem.MEPModel and elem.MEPModel.ConnectorManager:
                        for conn in elem.MEPModel.ConnectorManager.Connectors:
                            try: vec_dir = conn.CoordinateSystem.BasisZ
                            except: pass
                            
                            if not vec_dir or vec_dir.IsAlmostEqualTo(XYZ.Zero):
                                try: vec_dir = conn.Direction
                                except: pass
                                
                            if vec_dir and not vec_dir.IsAlmostEqualTo(XYZ.Zero):
                                # Extract dimensions directly from the terminal's connector!
                                shape = conn.Shape
                                if shape == ConnectorProfileType.Round:
                                    radius = conn.Radius
                                else:
                                    width = conn.Width
                                    height = conn.Height
                                break
                except: pass

                if not vec_dir or vec_dir.IsAlmostEqualTo(XYZ.Zero):
                    try: vec_dir = elem.FacingOrientation
                    except: pass
                    
                if not vec_dir or vec_dir.IsAlmostEqualTo(XYZ.Zero):
                    try: vec_dir = elem.GetTransform().BasisZ
                    except: pass
                    
                if not vec_dir or vec_dir.IsAlmostEqualTo(XYZ.Zero):
                    vec_dir = XYZ.BasisZ

                # 3. Create Native Revit Centerline Curve
                norm_dir = vec_dir.Normalize()
                offset_vec = norm_dir.Multiply(EXT_LEN_FT)
                pt_forward = origin.Add(offset_vec)
                pt_reverse = origin.Subtract(offset_vec)
                
                # We use Revit's Line.CreateBound so it works with CreateTransformed later
                loc_curve = Line.CreateBound(pt_reverse, pt_forward)
                
                # Fallback size if connector was completely missing
                if shape is None:
                    shape = ConnectorProfileType.Rectangular
                    width = 300.0 / 304.8
                    height = 300.0 / 304.8

        # --- STEP 2: APPLY YOUR OFFSET MATH ---
        # If it wasn't a duct or terminal, pass it through
        if not loc_curve:
            return item

        p0 = loc_curve.GetEndPoint(0)
        p1 = loc_curve.GetEndPoint(1)
        direction = p1.Subtract(p0).Normalize()

        is_vertical = abs(direction.Z) > 0.99
        ref_vec = XYZ.BasisX if is_vertical else XYZ.BasisZ

        side_vec = direction.CrossProduct(ref_vec).Normalize()
        up_vec = side_vec.CrossProduct(direction).Normalize()

        lines = []
        lines.append(loc_curve.ToProtoType()) # Center

        if shape == ConnectorProfileType.Round:
            for i in range(8):
                angle = i * (math.pi / 4)
                h_comp = side_vec.Multiply(math.cos(angle))
                v_comp = up_vec.Multiply(math.sin(angle))
                offset_vec = h_comp.Add(v_comp).Multiply(radius)

                trans = Transform.CreateTranslation(offset_vec)
                lines.append(loc_curve.CreateTransformed(trans).ToProtoType())
        else:
            w_off = width / 2.0
            h_off = height / 2.0

            offsets = [
                up_vec.Multiply(h_off), # Top
                up_vec.Multiply(-h_off), # Bottom
                side_vec.Multiply(w_off), # Left
                side_vec.Multiply(-w_off), # Right
                up_vec.Multiply(h_off).Add(side_vec.Multiply(w_off)), # TL
                up_vec.Multiply(h_off).Add(side_vec.Multiply(-w_off)), # TR
                up_vec.Multiply(-h_off).Add(side_vec.Multiply(w_off)), # BL
                up_vec.Multiply(-h_off).Add(side_vec.Multiply(-w_off)) # BR
            ]
            for vec in offsets:
                trans = Transform.CreateTranslation(vec)
                lines.append(loc_curve.CreateTransformed(trans).ToProtoType())

        return lines

    except Exception as e:
        return "PYTHON ERROR: " + str(e)

def process_list(input_list):
    """Recursively processes lists to handle any depth."""
    output = []
    for item in input_list:
        if isinstance(item, list):
            output.append(process_list(item))
        else:
            output.append(get_offset_lines(item))
    return output

# --- INPUT HANDLING ---
data_in = IN[0] if isinstance(IN[0], list) else [IN[0]]

OUT = process_list(data_in)
# ----------------------------------------
intersect = Geometry.Intersect(geometry=transform_5@L1, other=offseting_duct_location_in_8@L3)
flatten_15 = List.Flatten(list=intersect@@L3)
isEmpty_7 = List.IsEmpty(list=flatten_15@@L2)
allFalse = List.AllFalse(list=isEmpty_7@L2)
filterByBoolMask_20 = List.FilterByBoolMask(list=flatten_13, mask=allFalse)
filterByBoolMask_21 = List.FilterByBoolMask(list=flatten_14, mask=allFalse)
filterByBoolMask_22 = List.FilterByBoolMask(list=flatten_15, mask=isEmpty_7)
filterByBoolMask_23 = List.FilterByBoolMask(list=filterByBoolMask_22.out, mask=allFalse)
filterByBoolMask_24 = List.FilterByBoolMask(list=transform_5, mask=allFalse)
filterByBoolMask_25 = List.FilterByBoolMask(list=flatten_9, mask=isEmpty_7)
filterByBoolMask_26 = List.FilterByBoolMask(list=filterByBoolMask_25.out, mask=allFalse)

cleanParallelData_10 = Lists.CleanParallelData(Data=cycle_2, Guide=code_block_21)
flatten_16 = List.Flatten(list=cleanParallelData_10.CleanedGuide)
id_9 = Element.Id(element=flatten_16)
flatten_17 = List.Flatten(list=cleanParallelData_10.CleanedData)
string_from_object_7 = FromObject(object=flatten_17)
code_block_44 = CodeBlock(ID_=id_9, CS_=string_from_object_7) { ID_+CS_; }

# group: mapping elements
id_10 = Element.Id(element=filterByBoolMask_20.in)
string_from_object_8 = FromObject(object=filterByBoolMask_21.in)
code_block_45 = CodeBlock(ID_=id_10, CS_=string_from_object_8) { ID_+CS_; }
indexOf_3 = List.IndexOf(list=code_block_44, element=code_block_45)
isNull = Object.IsNull(object=indexOf_3)

# group: creating a curve extrusion of room bounadry line which will represent the wall of room
indexOf_4 = List.IndexOf(list=code_block_41, element=code_block_45)
getItemAtIndex_4 = List.GetItemAtIndex(list=flatten_10, index=indexOf_4)
ZAxis = Vector.ZAxis()
height = Python(IN[0]=filterByBoolMask_20.in)  # "wall.height"; CPython3
# ---------- height.python (53 lines) ----------
# -*- coding: utf-8 -*-
# IN[0] : Wall / List / Nested List
# OUT   : Height in mm (same structure)

import clr

# Revit API
clr.AddReference("RevitAPI")
from Autodesk.Revit.DB import BuiltInParameter

# -----------------------------
# Helpers
# -----------------------------

def ft_to_mm(x):
    return x * 304.8


def get_wall_height_mm(wall):
    if wall is None:
        return None

    try:
        # Get computed height directly
        param = wall.get_Parameter(BuiltInParameter.WALL_USER_HEIGHT_PARAM)

        if param and param.HasValue:
            height_ft = param.AsDouble()

            if height_ft <= 0:
                return None

            return ft_to_mm(height_ft)

        return None

    except:
        return None


def process(data):
    if isinstance(data, list):
        return [process(i) for i in data]
    else:
        wall = UnwrapElement(data)
        return get_wall_height_mm(wall)


# -----------------------------
# Execute
# -----------------------------

OUT = process(IN[0])
# ----------------------------------------
extrude = Curve.Extrude(curve=getItemAtIndex_4, direction=ZAxis, distance=height)
wall_thickness = Python(IN[0]=filterByBoolMask_20.in)  # CPython3
# ---------- wall_thickness.python (36 lines) ----------
import clr

# Import Revit API
clr.AddReference('RevitAPI')
from Autodesk.Revit.DB import Wall

# Metric Conversion
FEET_TO_MM = 304.8

def get_wall_thickness(item):
    if item is None:
        return None
        
    try:
        # Safely unwrap Dynamo elements to access the native Revit DB object
        elem = item.InternalElement if hasattr(item, "InternalElement") else item
        
        # Ensure the element is actually a Wall before querying
        if isinstance(elem, Wall):
            width_ft = elem.Width
            return width_ft * FEET_TO_MM
        else:
            return "Not a Wall"
            
    except Exception as e:
        return "PYTHON ERROR: " + str(e)

# Recursive engine to perfectly maintain nested list structures
def process_data(data):
    if isinstance(data, (list, tuple)):
        return [process_data(x) for x in data]
    else:
        return get_wall_thickness(data)

# --- EXECUTION ---
OUT = process_data(IN[0])
# ----------------------------------------
thicken = Surface.Thicken(surface=extrude, thickness=wall_thickness)
isNull_2 = Object.IsNull(object=thicken)

# group: if wall belongs to required room function and has required fire rating also then taking its solid instead of curve extrusion
if_ = RefactoredIf(test=isNull, true=thicken, false=filterByBoolMask_24.in, lacing=Shortest)

# group: Considering wall profile clashes and getting point on duct location curve if duct is clashing with wall partially
offseting_duct_location_in_8_2 = Python(IN[0]=filterByBoolMask_26.in)  # "offseting duct location in 8 directions"; CPython3; same code as offseting_duct_location_in_8
intersect_2 = Geometry.Intersect(geometry=if_@L1, other=offseting_duct_location_in_8_2@L3)
flatten_18 = List.Flatten(list=intersect_2@@L3)
isEmpty_8 = List.IsEmpty(list=flatten_18@@L2)
filterByBoolMask_27 = List.FilterByBoolMask(list=filterByBoolMask_23.in, mask=isEmpty_8)
filterByBoolMask_28 = List.FilterByBoolMask(list=filterByBoolMask_26.in, mask=isEmpty_8)

cleanParallelData_11 = Lists.CleanParallelData(Data=filterByBoolMask_27.out, Guide=filterByBoolMask_28.out)

# group: Wall clashing ducts (same wall may have fire rating also)
firstItem = List.FirstItem(list=cleanParallelData_11.CleanedData@@L2)
wall_clashing_duct_lines = List.Flatten(list=firstItem)
wall_clashing_ducts = List.Flatten(list=cleanParallelData_11.CleanedGuide)

cleanParallelData_12 = Lists.CleanParallelData(Data=filterByBoolMask_20.in, Guide=filterByBoolMask_28.out)
id_11 = Element.Id(element=cleanParallelData_12.CleanedData)
cleanParallelData_13 = Lists.CleanParallelData(Data=filterByBoolMask_21.in, Guide=filterByBoolMask_28.out)
string_from_object_9 = FromObject(object=cleanParallelData_13.CleanedData)
code_block_46 = CodeBlock(ID_=id_11, CS_=string_from_object_9) { ID_+CS_; }
count_3 = List.Count(list=firstItem@L2)
cycle_3 = List.Cycle(list=code_block_46, amount=count_3, lacing=Shortest)
flatten_19 = List.Flatten(list=cycle_3)

# group: Removing Duplicate lines
code_block_47 = CodeBlock { false; }
clean = List.Clean(list=wall_clashing_duct_lines, preserveIndices=code_block_47)
clean_2 = List.Clean(list=wall_clashing_ducts, preserveIndices=code_block_47)
clean_3 = List.Clean(list=flatten_19, preserveIndices=code_block_47)
python_script_2 = Python(IN[0]=clean, IN[1]=clean_2, IN[2]=clean_3)  # CPython3
# ---------- python_script_2.python (86 lines) ----------
# -*- coding: utf-8 -*-
# IN[0] : Dynamo Lines (may contain duplicates)
# IN[1] : Mapped ducts (index aligned with IN[0])
# IN[2] : Mapped string data (index aligned with IN[0])
# OUT   : [uniqueLines, uniqueMappedDucts, uniqueMappedStrings]

import clr

clr.AddReference("ProtoGeometry")
from Autodesk.DesignScript.Geometry import Line

# -----------------------------
# Helpers
# -----------------------------

def to_list(obj):
    if hasattr(obj, '__iter__'):
        return obj
    else:
        return [obj]

def distance(pt1, pt2):
    return pt1.DistanceTo(pt2)

def lines_are_equal(l1, l2, tol):
    """
    Checks if two lines are equal within tolerance (2mm)
    Handles reversed direction as well.
    """
    if l1 is None or l2 is None:
        return False

    s1, e1 = l1.StartPoint, l1.EndPoint
    s2, e2 = l2.StartPoint, l2.EndPoint

    # Same direction
    cond1 = (
        distance(s1, s2) <= tol and
        distance(e1, e2) <= tol
    )

    # Reversed direction
    cond2 = (
        distance(s1, e2) <= tol and
        distance(e1, s2) <= tol
    )

    return cond1 or cond2

# -----------------------------
# Main
# -----------------------------

lines = to_list(IN[0]) if IN[0] else []
mapped = to_list(IN[1]) if IN[1] else []
string_data = to_list(IN[2]) if IN[2] else []

# Check to ensure all three lists have the same length before processing
if len(lines) != len(mapped) or len(lines) != len(string_data):
    OUT = [[], [], []]
else:
    tol_mm = 2.0  # 2 mm tolerance

    unique_lines = []
    unique_mapped = []
    unique_strings = []

    # Zip all three lists together so they stay perfectly aligned
    for line, data, s_data in zip(lines, mapped, string_data):

        if not isinstance(line, Line):
            continue

        is_duplicate = False

        for existing in unique_lines:
            if lines_are_equal(line, existing, tol_mm):
                is_duplicate = True
                break

        if not is_duplicate:
            unique_lines.append(line)
            unique_mapped.append(data)
            unique_strings.append(s_data) # Keep the string data aligned

    OUT = [unique_lines, unique_mapped, unique_strings]
# ----------------------------------------

# group: Grouping lines which are colinear, parallel and mid point distance is less than 500mm (this will ignor the case where splitted duct is clashing wall, this will avoid placement of two damper close to each other)
code_block_48 = CodeBlock(Lines_=python_script_2) { Lines_[0]; }
code_block_49 = CodeBlock(Ducts_=python_script_2) { Ducts_[1]; }
code_block_50 = CodeBlock(walls_cs=python_script_2) { walls_cs[2]; }
python_script_3 = Python(IN[0]=code_block_48, IN[1]=code_block_49, IN[2]=code_block_50)  # CPython3
# ---------- python_script_3.python (230 lines) ----------
import clr
import math

clr.AddReference('ProtoGeometry')
from Autodesk.DesignScript.Geometry import Line, Point, Vector

# ---------------------------
# PARAMETERS
# ---------------------------
MAX_GAP_MM = 500.0
COLLINEAR_TOL_MM = 1e-6   
ANG_TOL_RAD = 1e-6
EPS = 1e-12

# ---------------------------
# BASIC HELPERS
# ---------------------------
def as_list(x):
    if x is None:
        return []
    if isinstance(x, Line):
        return [x]
    try:
        return [i for i in x if i is not None]
    except:
        return []

def v_len(v):
    return math.sqrt(v.X*v.X + v.Y*v.Y + v.Z*v.Z)

def v_dot(a, b):
    return a.X*b.X + a.Y*b.Y + a.Z*b.Z

def v_cross(a, b):
    return Vector.ByCoordinates(
        a.Y*b.Z - a.Z*b.Y,
        a.Z*b.X - a.X*b.Z,
        a.X*b.Y - a.Y*b.X
    )

def pt_sub(a, b):
    return Vector.ByCoordinates(a.X - b.X, a.Y - b.Y, a.Z - b.Z)

def v_unit(v):
    l = v_len(v)
    if l < EPS:
        return None
    return Vector.ByCoordinates(v.X/l, v.Y/l, v.Z/l)

def line_dir(l):
    return pt_sub(l.EndPoint, l.StartPoint)

def line_dir_unit(l):
    return v_unit(line_dir(l))

def midpoint(l):
    s, e = l.StartPoint, l.EndPoint
    return Point.ByCoordinates((s.X+e.X)/2.0, (s.Y+e.Y)/2.0, (s.Z+e.Z)/2.0)

# ---------------------------
# GEOMETRY TESTS
# ---------------------------
def are_parallel(u_unit, v_unit, angTol=ANG_TOL_RAD):
    c = v_cross(u_unit, v_unit)
    return v_len(c) <= math.sin(angTol) + 1e-15

def point_to_infinite_line_distance(p, a, u_vec):
    ap = pt_sub(p, a)
    cu = v_cross(ap, u_vec)
    denom = v_len(u_vec)
    if denom < EPS:
        return float('inf')
    return v_len(cu) / denom

def point_on_infinite_line(p, a, u_vec, tolMm=COLLINEAR_TOL_MM):
    return point_to_infinite_line_distance(p, a, u_vec) <= tolMm

def strictly_collinear(l1, l2):
    u1u = line_dir_unit(l1)
    u2u = line_dir_unit(l2)
    if u1u is None or u2u is None:
        return False
    if not are_parallel(u1u, u2u):
        return False

    a = l1.StartPoint
    u = line_dir(l1)  
    if not point_on_infinite_line(l2.StartPoint, a, u, COLLINEAR_TOL_MM):
        return False
    if not point_on_infinite_line(l2.EndPoint, a, u, COLLINEAR_TOL_MM):
        return False
    return True

def signed_param_on_line(p, a, u_unit):
    return v_dot(pt_sub(p, a), u_unit)

def midpoint_gap_along_line(l1, l2):
    u = line_dir_unit(l1)
    if u is None:
        return float('inf')
    a = l1.StartPoint
    t1 = signed_param_on_line(midpoint(l1), a, u)
    t2 = signed_param_on_line(midpoint(l2), a, u)
    return abs(t2 - t1)

# ---------------------------
# CONNECTED COMPONENTS
# ---------------------------
def connected_components(indices, link_fn):
    idx_list = list(indices)
    m = len(idx_list)
    if m <= 1:
        return [idx_list]

    adj = [[] for _ in range(m)]
    for i in range(m):
        for j in range(i+1, m):
            if link_fn(idx_list[i], idx_list[j]):
                adj[i].append(j)
                adj[j].append(i)

    visited = [False]*m
    comps = []
    for i in range(m):
        if visited[i]:
            continue
        stack = [i]
        visited[i] = True
        comp = []
        while stack:
            k = stack.pop()
            comp.append(idx_list[k])
            for nb in adj[k]:
                if not visited[nb]:
                    visited[nb] = True
                    stack.append(nb)
        comps.append(comp)
    return comps

# ---------------------------
# MAIN GROUPING
# ---------------------------
def group_indices_by_rules(lines):
    n = len(lines)
    if n == 0:
        return []
    if n == 1:
        return [[0]]

    all_idx = range(n)

    # Step 1: strict collinear components
    collinear_comps = connected_components(
        all_idx,
        lambda i, j: strictly_collinear(lines[i], lines[j]) or strictly_collinear(lines[j], lines[i])
    )

    # Step 2: split by midpoint gap
    final_idx_groups = []
    for comp in collinear_comps:
        gap_comps = connected_components(
            comp,
            lambda i, j: (strictly_collinear(lines[i], lines[j]) or strictly_collinear(lines[j], lines[i])) and
                         (midpoint_gap_along_line(lines[i], lines[j]) <= MAX_GAP_MM + 1e-6)
        )
        for g in gap_comps:
            final_idx_groups.append(g)

    return final_idx_groups

# ---------------------------
# Inputs
# ---------------------------

raw_lines = as_list(IN[0])
lines = [l for l in raw_lines if isinstance(l, Line)]

mapped = IN[1]  
mapped_list = []
if mapped is None:
    mapped_list = []
else:
    try:
        mapped_list = list(mapped)
    except:
        mapped_list = [mapped]

string_data = IN[2]  
string_list = []
if string_data is None:
    string_list = []
else:
    try:
        string_list = list(string_data)
    except:
        string_list = [string_data]


# ---------------------------
# Compute groups
# ---------------------------

idx_groups = group_indices_by_rules(lines)
grouped_lines = [[lines[i] for i in grp] for grp in idx_groups]

# Group mapped items and string data using SAME indices
grouped_mapped = []
grouped_strings = []

for grp in idx_groups:
    g_mapped = []
    g_strings = []
    
    for i in grp:
        # Map IN[1]
        if 0 <= i < len(mapped_list):
            g_mapped.append(mapped_list[i])
        else:
            g_mapped.append(None) 
            
        # Map IN[2]
        if 0 <= i < len(string_list):
            g_strings.append(string_list[i])
        else:
            g_strings.append(None) 

    grouped_mapped.append(g_mapped)
    grouped_strings.append(g_strings)

OUT = (grouped_lines, grouped_mapped, grouped_strings)
# ----------------------------------------
code_block_51 = CodeBlock(Ducts_=python_script_3) { Ducts_[1]; }
code_block_52 = CodeBlock(Lines_=python_script_3) { Lines_[0]; }
code_block_53 = CodeBlock(WALL_CS_=python_script_3) { WALL_CS_[2]; }

ducts = List.FirstItem(list=code_block_51@L2)
lines = List.FirstItem(list=code_block_52@L2)

# group: Projecting clash point on location line of duct
get_location_2 = Python(IN[0]=ducts)  # CPython3; same code as get_location
midpoint = Geometry.Line.Midpoint(line=lines)
parameterAtPoint = Curve.ParameterAtPoint(curve=get_location_2, point=midpoint)
pointAtParameter_2 = Curve.PointAtParameter(curve=get_location_2, param=parameterAtPoint)

# group: creating a line at wall duct intersection and checking whether it is intersecting with any respective duct connected fire dampers
direction_3 = Line.Direction(line=get_location_2)
code_block_54 = CodeBlock { 400; }
translate = Geometry.Translate(geometry=pointAtParameter_2, direction=direction_3, distance=code_block_54)
reverse = Vector.Reverse(vector=direction_3)
translate_2 = Geometry.Translate(geometry=pointAtParameter_2, direction=reverse, distance=code_block_54)
byStartPointEndPoint = Line.ByStartPointEndPoint(startPoint=translate, endPoint=translate_2)
getConnectedElements = OpenMEPRevit.Element.Element.GetConnectedElements(elem=code_block_51)
flatten_20 = List.Flatten(list=getConnectedElements@@L3)
filtering_only_fire_dampers = Python(IN[0]=flatten_20)  # CPython3
# ---------- filtering_only_fire_dampers.python (56 lines) ----------
import clr

# RevitServices
clr.AddReference("RevitServices")
from RevitServices.Persistence import DocumentManager
doc = DocumentManager.Instance.CurrentDBDocument

# RevitAPI
clr.AddReference("RevitAPI")
from Autodesk.Revit.DB import *

# ------------------------------------------------------------
# SAFE UNWRAP
# ------------------------------------------------------------
def unwrap(x):
    if hasattr(x, "InternalElement"):
        return x.InternalElement
    return x

# ------------------------------------------------------------
# FIRE DAMPER CHECK
# ------------------------------------------------------------
def is_fire_damper(elem):
    r = unwrap(elem)
    if not r or not r.Category:
        return False

    # Check category
    if r.Category.Name != "Duct Accessories":
        return False

    # Check family name
    try:
        fam_name = r.Symbol.Family.Name.lower()
    except:
        return False

    return ("fire" in fam_name) and ("damper" in fam_name)

# ------------------------------------------------------------
# RECURSIVE STRUCTURE PRESERVER
# ------------------------------------------------------------
def process(item):
    if isinstance(item, list):
        return [process(i) for i in item]
    else:
        if is_fire_damper(item):
            return item
        else:
            return []

# ------------------------------------------------------------
# MAIN
# ------------------------------------------------------------
data = IN[0]
OUT = process(data)
# ----------------------------------------
uniqueItems_2 = List.UniqueItems(list=filtering_only_fire_dampers@@L3)
getLocation_3 = Element.GetLocation(element=uniqueItems_2)
code_block_55 = CodeBlock { 50; }
byCenterPointRadius = Sphere.ByCenterPointRadius(centerPoint=getLocation_3, radius=code_block_55)
doesIntersect = Geometry.DoesIntersect(geometry=byStartPointEndPoint@L1, other=byCenterPointRadius@@L3)

WALL_CS = List.FirstItem(list=code_block_53@L2)

# group: Points to place dampers
python_empty_2_false = Custom[Python Empty 2 False](VARIN=doesIntersect@@L3)  # package Synthesize toolkit; Python Null 2 Empty
anyTrue_4 = List.AnyTrue(list=python_empty_2_false@@L2)
filterByBoolMask_29 = List.FilterByBoolMask(list=pointAtParameter_2, mask=anyTrue_4)
code_block_56 = CodeBlock(points_to_palce_dampers=filterByBoolMask_29.out) { points_to_palce_dampers; }
flatten_21 = List.Flatten(list=code_block_56)
filterByBoolMask_30 = List.FilterByBoolMask(list=ducts, mask=anyTrue_4)
code_block_57 = CodeBlock(ducts_=filterByBoolMask_30.out) { ducts_; }
flatten_22 = List.Flatten(list=code_block_57)
filterByBoolMask_31 = List.FilterByBoolMask(list=WALL_CS, mask=anyTrue_4)
code_block_58 = CodeBlock(MAPPED_WALL_CS=filterByBoolMask_31.out) { MAPPED_WALL_CS; }
flatten_23 = List.Flatten(list=code_block_58)

# group: Removing AT from list
getCategory = Element.GetCategory(element=flatten_22)
string_from_object_10 = FromObject(object=getCategory)
code_block_59 = CodeBlock(cat_=string_from_object_10) { cat_=="Ducts"; }
filterByBoolMask_32 = List.FilterByBoolMask(list=flatten_21, mask=code_block_59)
filterByBoolMask_33 = List.FilterByBoolMask(list=flatten_22, mask=code_block_59)
cleanParallelData_14 = Lists.CleanParallelData(Data=filterByBoolMask_32.in, Guide=filterByBoolMask_33.in)
filterByBoolMask_34 = List.FilterByBoolMask(list=flatten_23, mask=code_block_59)
cleanParallelData_15 = Lists.CleanParallelData(Data=filterByBoolMask_34.in, Guide=filterByBoolMask_33.in)

# group: removes redundant points on the same duct to prevent overlapping fire dampers. It ensures a minimum 300mm spacing by checking each point against previously accepted locations for that specific duct.
python_script_4 = Python(IN[0]=cleanParallelData_14.CleanedGuide, IN[1]=cleanParallelData_14.CleanedData, IN[2]=cleanParallelData_15.CleanedData)  # CPython3
# ---------- python_script_4.python (54 lines) ----------
import clr
clr.AddReference('ProtoGeometry')
from Autodesk.DesignScript.Geometry import *

# --- Inputs ---
ducts_in = IN[0] if isinstance(IN[0], list) else [IN[0]]
points_in = IN[1] if isinstance(IN[1], list) else [IN[1]]
strings_in = IN[2] if isinstance(IN[2], list) else [IN[2]]

# Dictionary to store accepted points per duct ID
# Key = Duct Id, Value = List of accepted Point objects
duct_groups = {}

final_ducts = []
final_points = []
final_strings = []  # NEW: Parallel list for the mapped string data

# Iterate through all three paired lists simultaneously
for duct, point, string_data in zip(ducts_in, points_in, strings_in):
    if not duct or not point: 
        continue
    
    try:
        d_id = duct.Id
    except:
        continue # Safely skip if element lacks an ID
    
    # If duct hasn't been seen yet, start a new list
    if d_id not in duct_groups:
        duct_groups[d_id] = [point]
        
        final_ducts.append(duct)
        final_points.append(point)
        final_strings.append(string_data) # Map the string
    else:
        # Check distance against all points already accepted for THIS duct
        is_too_close = False
        for accepted_pt in duct_groups[d_id]:
            if point.DistanceTo(accepted_pt) < 300.0:
                is_too_close = True
                break
        
        # If the point is safe (more than 300mm from all others), keep it
        if not is_too_close:
            duct_groups[d_id].append(point)
            
            final_ducts.append(duct)
            final_points.append(point)
            final_strings.append(string_data) # Map the string

# OUT[0] = Cleaned Ducts
# OUT[1] = Cleaned Points
# OUT[2] = Cleaned Strings
OUT = [final_ducts, final_points, final_strings]
# ----------------------------------------
code_block_60 = CodeBlock(Ducts_=python_script_4, Pints_=python_script_4, WALL_CS=python_script_4) { Ducts_[0]; Pints_[1]; WALL_CS[2]; }

# group: Rejects ducts shorter than 200mm and automatically shifts the insertion point to maintain a minimum 100mm buffer (half-width + clearance) from both ends.
getLocation_4 = Element.GetLocation(element=code_block_60.out0)
python_script_5 = Python(IN[0]=code_block_60.out0, IN[1]=getLocation_4, IN[2]=code_block_60.out1, IN[3]=code_block_60.out2)  # CPython3
# ---------- python_script_5.python (72 lines) ----------
import clr
clr.AddReference('ProtoGeometry')
from Autodesk.DesignScript.Geometry import *

def process_placement():
    # Constants in mm
    DAMPER_WIDTH = 150.0
    CLEARANCE = 25.0
    
    # Center of damper must be at least 100mm from duct ends
    SAFE_BUFFER = (DAMPER_WIDTH / 2.0) + CLEARANCE 
    MIN_TOTAL_LENGTH = DAMPER_WIDTH + (2 * CLEARANCE) # 200mm

    # Ensure inputs are treated as lists
    ducts = IN[0] if isinstance(IN[0], list) else [IN[0]]
    lines = IN[1] if isinstance(IN[1], list) else [IN[1]]
    points = IN[2] if isinstance(IN[2], list) else [IN[2]]
    strings = IN[3] if isinstance(IN[3], list) else [IN[3]] # NEW: String Data Input

    success_ducts = []
    success_points = []
    success_strings = [] # NEW

    failed_ducts = []
    failed_msgs = []
    failed_strings = [] # NEW

    # Iterate through all inputs, now zipping 4 parallel lists
    for d, l, p, s in zip(ducts, lines, points, strings):
        if not d or not l or not p:
            continue
            
        total_length = l.Length

        # 1. Filter: Check if duct is too short
        if total_length < MIN_TOTAL_LENGTH:
            failed_ducts.append(d)
            failed_msgs.append("Place damper Manually - Dont have enough length to place damper")
            failed_strings.append(s) # Map string to failure list
            continue
        
        # 2. Project input point to the duct line axis
        proj_point = l.ClosestPointTo(p)
        
        # 3. Calculate distances from ends
        dist_start = l.StartPoint.DistanceTo(proj_point)
        dist_end = l.EndPoint.DistanceTo(proj_point)
        
        final_point = proj_point
        
        # 4. Adjustment Logic (Shifting)
        if dist_start < SAFE_BUFFER:
            # Shift away from Start
            move_vec = l.Direction
            move_dist = SAFE_BUFFER - dist_start
            final_point = proj_point.Translate(move_vec, move_dist)
            
        elif dist_end < SAFE_BUFFER:
            # Shift away from End
            move_vec = l.Direction.Reverse()
            move_dist = SAFE_BUFFER - dist_end
            final_point = proj_point.Translate(move_vec, move_dist)
            
        # Add to success list
        success_ducts.append(d)
        success_points.append(final_point)
        success_strings.append(s) # Map string to success list

    # Return grouped outputs
    return [[success_ducts, success_points, success_strings], [failed_ducts, failed_msgs, failed_strings]]

OUT = process_placement()
# ----------------------------------------
code_block_61 = CodeBlock(Ducts_=python_script_5, Points_=python_script_5, WARNINGS_ducts=python_script_5, WARNINGS_message=python_script_5, WALL_CS_=python_script_5) { Ducts_[0][0]; Points_[0][1]; WARNINGS_ducts[1][0]; WARNINGS_message[1][1]; WALL_CS_[0][2]; }

python_script_6 = Python(IN[0]=code_block_61.out0, IN[1]=code_block_61.out1, IN[2]=code_block_61.out4)  # CPython3
# ---------- python_script_6.python (105 lines) ----------
# -*- coding: utf-8 -*-
# IN[0] : List of Ducts
# IN[1] : List of Points (mapped index-to-index)
# IN[2] : List of Strings (mapped index-to-index)
# OUT   : [flattenedDucts, flattenedSortedPoints, flattenedSortedStrings]

import clr

# Revit API
clr.AddReference("RevitAPI")
from Autodesk.Revit.DB import LocationCurve

# Revit Services
clr.AddReference("RevitServices")
from RevitServices.Persistence import DocumentManager

# ProtoGeometry
clr.AddReference("ProtoGeometry")
from Autodesk.DesignScript.Geometry import Point

doc = DocumentManager.Instance.CurrentDBDocument

# -----------------------------
# Helpers
# -----------------------------

def to_list(obj):
    if hasattr(obj, '__iter__'):
        return obj
    else:
        return [obj]

def get_curve_parameter(curve, point):
    """
    Returns normalized parameter (0–1) of point on curve.
    """
    try:
        result = curve.Project(point.ToXyz())
        if result:
            return result.Parameter
        return None
    except:
        return None

# -----------------------------
# Main
# -----------------------------

ducts = to_list(IN[0]) if IN[0] else []
points = to_list(IN[1]) if IN[1] else []
strings = to_list(IN[2]) if IN[2] else [] # NEW: Capture the string data

# Ensure all three lists have the same length
if len(ducts) != len(points) or len(ducts) != len(strings):
    OUT = [[], [], []]
else:
    ducts = [UnwrapElement(d) for d in ducts]
    
    # Group by duct Id
    grouped = {}

    for duct, pt, s_data in zip(ducts, points, strings):

        if duct is None:
            continue

        loc = duct.Location
        if not isinstance(loc, LocationCurve):
            continue

        curve = loc.Curve
        param = get_curve_parameter(curve, pt)

        if param is None:
            continue

        key = duct.Id.IntegerValue

        if key not in grouped:
            grouped[key] = {
                "duct": duct,
                "data": []
            }

        # Store the parameter, point, AND string together
        grouped[key]["data"].append((param, pt, s_data))

    # Sort inside each duct group
    flat_ducts = []
    flat_points = []
    flat_strings = [] # NEW

    for g in grouped.values():

        duct = g["duct"]
        # Sorting by the first element (param) naturally keeps the rest of the tuple aligned
        sorted_pts = sorted(g["data"], key=lambda x: x[0])

        for param, pt, s_data in sorted_pts:
            flat_ducts.append(duct)
            flat_points.append(pt)
            flat_strings.append(s_data) # Append the aligned string

    # Output all three parallel lists
    OUT = [flat_ducts, flat_points, flat_strings]
# ----------------------------------------
code_block_62 = CodeBlock(Ducts_=python_script_6, points_=python_script_6, WALL_CS=python_script_6) { Ducts_[0]; points_[1]; WALL_CS[2]; }
lastItem = List.LastItem(list=valueAtKey_2@L2)

# group: checking if air terminal duct is alreday clashing with walls
cleanParallelData_16 = Lists.CleanParallelData(Data=filterByBoolMask_32.out, Guide=filterByBoolMask_33.out)
indexOf_5 = List.IndexOf(list=valueAtKey, element=cleanParallelData_16.CleanedGuide)
getItemAtIndex_5 = List.GetItemAtIndex(list=lastItem, index=indexOf_5)
flatten_24 = List.Flatten(list=getItemAtIndex_5)
contains = List.Contains(list=flatten_24, item=ducts, lacing=CrossProduct)
getItemAtIndex_6 = List.GetItemAtIndex(list=valueAtKey_3, index=indexOf_5)
flatten_25 = List.Flatten(list=getItemAtIndex_6)

anyTrue_5 = List.AnyTrue(list=contains@L2)

# group (continued): checking if air terminal duct is alreday clashing with walls
filterByBoolMask_35 = List.FilterByBoolMask(list=flatten_24, mask=anyTrue_5)
filterByBoolMask_36 = List.FilterByBoolMask(list=flatten_25, mask=anyTrue_5)

code_block_63 = CodeBlock(AT_DUCTS=filterByBoolMask_35.out) { AT_DUCTS; }
join_5 = List.Join(list0=code_block_62.out0, list1=code_block_63)
join_6 = List.Join(list0=code_block_62.out1, list1=filterByBoolMask_36.out)

# group: FD - Grouping Round and rectangular ducts
python_script_7 = Python(IN[0]=join_5, IN[1]=join_6)  # CPython3
# ---------- python_script_7.python (36 lines) ----------
import clr
clr.AddReference('RevitAPI')
from Autodesk.Revit.DB import *

# Inputs
ducts = IN[0] if isinstance(IN[0], list) else [IN[0]]
points = IN[1] if isinstance(IN[1], list) else [IN[1]]

# Output Lists
rect_ducts = []
rect_points = []
round_ducts = []
round_points = []

for d, p in zip(ducts, points):
    if not d: continue
    
    # Get the duct element (unwrap if necessary)
    obj = UnwrapElement(d)
    
    # Check Shape
    # 1 = Round, 2 = Rectangular, 3 = Oval
    shape = obj.DuctType.Shape
    
    if shape == ConnectorProfileType.Round:
        round_ducts.append(d)
        round_points.append(p)
    else:
        # Groups Rectangular and Oval together
        rect_ducts.append(d)
        rect_points.append(p)

# Output: 
# 0 = Rectangular/Oval [Ducts, Points]
# 1 = Round [Ducts, Points]
OUT = [[rect_ducts, rect_points], [round_ducts, round_points]]
# ----------------------------------------
code_block_64 = CodeBlock(rect_ducts=python_script_7, rect_points=python_script_7, round_ducts=python_script_7, round_points=python_script_7) { rect_ducts[0][0]; rect_points[0][1]; round_ducts[1][0]; round_points[1][1]; }

# group: creating record to know the shaft walls
filterByBoolMask_37 = List.FilterByBoolMask(list=cleanParallelData_5.CleanedData, mask=anyTrue)
name = Room.Name(room=filterByBoolMask_37.in)
code_block_65 = CodeBlock(walls_=cleanParallelData_7.CleanedGuide) { walls_; }
id_12 = Element.Id(element=code_block_65)
string_from_object_11 = FromObject(object=cleanParallelData_7.CleanedData)
code_block_66 = CodeBlock(wall_id=id_12, cs_=string_from_object_11) { wall_id+cs_; }
count_4 = List.Count(list=code_block_66@L2)
cycle_4 = List.Cycle(list=name, amount=count_4, lacing=Shortest)
flatten_26 = List.Flatten(list=cycle_4)
flatten_27 = List.Flatten(list=code_block_66)

groupByKey = List.GroupByKey(list=flatten_26, keys=flatten_27)

# group: SHAFT DUCTS
code_block_67 = CodeBlock(AWEG=groupByKey.groups) { AWEG; }
code_block_68 = CodeBlock(AWEG=groupByKey.uniqueKeys) { AWEG; }
indexOf_6 = List.IndexOf(list=code_block_68, element=code_block_62.out2)
getItemAtIndex_7 = List.GetItemAtIndex(list=code_block_67, index=indexOf_6)
code_block_69 = CodeBlock { "SHAFT"; true; }
contains_2 = String.Contains(string=getItemAtIndex_7, searchFor=code_block_69.out0, ignoreCase=code_block_69.out1)
anyTrue_6 = List.AnyTrue(list=contains_2@L2)
code_block_70 = CodeBlock { false; }
replaceNull_2 = archilab.Lists.Lists.ReplaceNull(list=anyTrue_6, replacement=code_block_70)
count_5 = List.Count(list=code_block_63)
cycle_5 = List.Cycle(list=code_block_70, amount=count_5)
join_7 = List.Join(list0=replaceNull_2, list1=cycle_5)

mepfitting_bypointsandcurve = Python(IN[0]=code_block_64.out0, IN[1]=code_block_64.out1, IN[2]=fireDamperUI.RectFD, IN[3]=fireDamperUI.RectShaft, IN[4]=join_7)  # "MEPFitting.ByPointsAndCurve(Damper elevation and double splitting )"; IronPython2
# ---------- mepfitting_bypointsandcurve.python (380 lines) ----------
import clr
import math

# Revit Services
clr.AddReference("RevitServices")
import RevitServices
from RevitServices.Persistence import DocumentManager
from RevitServices.Transactions import TransactionManager
doc = DocumentManager.Instance.CurrentDBDocument

# Revit API
clr.AddReference("RevitAPI")
from Autodesk.Revit.DB import *
from Autodesk.Revit.DB.Mechanical import *

# Geometry Conversion
clr.AddReference("RevitNodes")
import Revit
clr.ImportExtensions(Revit.Elements)
clr.ImportExtensions(Revit.GeometryConversion)

# ------------------------------------------------------
# 1. INPUT HANDLING (Standardizes Single vs List)
# ------------------------------------------------------
def to_list(input_item):
    if isinstance(input_item, list):
        return input_item
    if hasattr(input_item, "__iter__") and not isinstance(input_item, str):
        return input_item
    return [input_item]

ducts_in = to_list(UnwrapElement(IN[0]))
points_in = to_list(IN[1]) 
normal_fam_type = UnwrapElement(IN[2])    # IN[2]: Normal Damper
motorized_fam_type = UnwrapElement(IN[3]) # IN[3]: Motorized Damper
booleans_in = to_list(IN[4])              # IN[4]: Mapped Boolean List

# Ensure family types are single items
if isinstance(normal_fam_type, list): normal_fam_type = normal_fam_type[0]
if isinstance(motorized_fam_type, list): motorized_fam_type = motorized_fam_type[0]

# ------------------------------------------------------
# 2. HELPER FUNCTIONS (Untouched)
# ------------------------------------------------------
def IsParallel(dir1,dir2):
    if dir1.Normalize().IsAlmostEqualTo(dir2.Normalize()): return True
    if dir1.Normalize().Negate().IsAlmostEqualTo(dir2.Normalize()): return True
    return False

def GetDirection(faminstance):
    for c in faminstance.MEPModel.ConnectorManager.Connectors:
        return c.CoordinateSystem.BasisZ

def GetClosestDirection(faminstance, lineDirection):
    conndir = None
    flat_linedir = XYZ(lineDirection.X,lineDirection.Y,0).Normalize()
    for conn in faminstance.MEPModel.ConnectorManager.Connectors:
        conndir = conn.CoordinateSystem.BasisZ
        if flat_linedir.IsAlmostEqualTo(conndir):
            return conndir
    return conndir

def to_xyz(pt):
    if hasattr(pt, "ToXyz"): return pt.ToXyz()
    return pt

def get_connectors(element):
    if isinstance(element, FamilyInstance):
        return [c for c in element.MEPModel.ConnectorManager.Connectors]
    elif isinstance(element, Duct):
        return [c for c in element.ConnectorManager.Connectors]
    return []

def connect_duct_to_damper(duct_elem, damper_elem):
    """Connects a duct to a damper if their connectors are co-located."""
    duct_conns = get_connectors(duct_elem)
    damper_conns = get_connectors(damper_elem)
    
    for dc in duct_conns:
        for fc in damper_conns:
            if dc.Origin.DistanceTo(fc.Origin) < 0.01:
                if not dc.IsConnectedTo(fc):
                    try:
                        dc.ConnectTo(fc)
                        return 
                    except:
                        pass

# ------------------------------------------------------
# 3. EXPLICIT LEVEL & ELEVATION MATCHING (Untouched)
# ------------------------------------------------------
def MatchLevelAndElevation(duct, damper):
    """Explicitly copies the Reference Level and Middle Elevation values from Duct to Damper."""
    
    # 1. Copy Reference Level
    level_id = ElementId.InvalidElementId
    try:
        duct_lvl_p = duct.get_Parameter(BuiltInParameter.RBS_START_LEVEL_PARAM)
        if duct_lvl_p and duct_lvl_p.AsElementId() != ElementId.InvalidElementId:
            level_id = duct_lvl_p.AsElementId()
        elif duct.ReferenceLevel:
            level_id = duct.ReferenceLevel.Id
            
        if level_id != ElementId.InvalidElementId:
            for p_id in [BuiltInParameter.FAMILY_LEVEL_PARAM, BuiltInParameter.INSTANCE_REFERENCE_LEVEL_PARAM]:
                damper_lvl_p = damper.get_Parameter(p_id)
                if damper_lvl_p and not damper_lvl_p.IsReadOnly:
                    damper_lvl_p.Set(level_id)
                    break
    except: pass

    # 2. Copy Middle Elevation (Offset) directly via Parameter Value
    try:
        duct_elev_p = duct.get_Parameter(BuiltInParameter.RBS_OFFSET_PARAM)
        if duct_elev_p and duct_elev_p.HasValue:
            exact_elevation_value = duct_elev_p.AsDouble()
            for p_id in [
                BuiltInParameter.INSTANCE_FREE_HOST_OFFSET_PARAM,
                BuiltInParameter.INSTANCE_ELEVATION_PARAM,
                BuiltInParameter.FAMILY_BASE_LEVEL_OFFSET_PARAM
            ]:
                damper_off_p = damper.get_Parameter(p_id)
                if damper_off_p and not damper_off_p.IsReadOnly:
                    damper_off_p.Set(exact_elevation_value)
                    break
    except: pass

# ------------------------------------------------------
# 4. PLACEMENT & ROTATION LOGIC (Untouched)
# ------------------------------------------------------
tempfamtype = None
xAxis = XYZ(1,0,0)

def placeFitting(duct, point_xyz, familytype, lineDirection):
    toggle = False
    isVertical = False
    
    global tempfamtype
    global xAxis
    
    if tempfamtype == None:
        tempfamtype = familytype
        toggle = True
    elif tempfamtype.Id != familytype.Id:
        toggle = True
        tempfamtype = familytype

    level = duct.ReferenceLevel
    width = 4
    height = 4
    radius = 2
    round = False

    connectors = duct.ConnectorManager.Connectors
    for c in connectors:
        if c.ConnectorType != ConnectorType.End: continue
        shape = c.Shape
        if shape == ConnectorProfileType.Round:
            radius = c.Radius
            round = True    
            break
        elif shape == ConnectorProfileType.Rectangular or shape == ConnectorProfileType.Oval:
            if abs(lineDirection.Z) == 1:
                isVertical = True
                yDir = c.CoordinateSystem.BasisY
            width = c.Width
            height = c.Height
            break
            
    # Place Instance exactly on the Level Z=0 relative plane
    placementPoint = XYZ(point_xyz.X, point_xyz.Y, level.Elevation)
    newfam = doc.Create.NewFamilyInstance(
        placementPoint, familytype, level, Structure.StructuralType.NonStructural
    )
    
    MatchLevelAndElevation(duct, newfam)
    doc.Regenerate()

    # Rotation
    transform = newfam.GetTransform()
    axis = Line.CreateUnbound(transform.Origin, transform.BasisZ)

    if toggle:
        xAxis = GetDirection(newfam)

    zAxis = XYZ(0,0,1)
    
    if isVertical:
        angle = xAxis.AngleOnPlaneTo(yDir,zAxis)
    else:
        angle = xAxis.AngleOnPlaneTo(lineDirection,zAxis)
    
    ElementTransformUtils.RotateElement(doc,newfam.Id,axis,angle)
    doc.Regenerate()
    
    if lineDirection.Z != 0:
        newAxis = GetClosestDirection(newfam,lineDirection)
        yAxis = newAxis.CrossProduct(zAxis)
        angle2 = newAxis.AngleOnPlaneTo(lineDirection,yAxis)
        axis2 = Line.CreateUnbound(transform.Origin, yAxis)
        ElementTransformUtils.RotateElement(doc,newfam.Id,axis2,angle2)
    
    # Set Sizes
    famconns = newfam.MEPModel.ConnectorManager.Connectors
    if round:
        for conn in famconns:
            if not IsParallel(lineDirection,conn.CoordinateSystem.BasisZ): continue
            if conn.Shape != shape: continue
            try: conn.Radius = radius
            except: pass
    else:
        for conn in famconns:
            if not IsParallel(lineDirection,conn.CoordinateSystem.BasisZ): continue
            if conn.Shape != shape: continue
            try: 
                conn.Width = width
                conn.Height = height
            except: pass

    return newfam

# ------------------------------------------------------
# 5. MAIN EXECUTION LOOP (Updated for Booleans)
# ------------------------------------------------------

TransactionManager.Instance.EnsureInTransaction(doc)

# Activate Families Once
if normal_fam_type and not normal_fam_type.IsActive:
    normal_fam_type.Activate()
    doc.Regenerate()
    
if motorized_fam_type and not motorized_fam_type.IsActive:
    motorized_fam_type.Activate()
    doc.Regenerate()

output_list = []

# Iterate through Ducts
for i, duct in enumerate(ducts_in):
    placed_dampers_for_this_duct = []
    
    try:
        # Handle mapped points and booleans
        pt_data = points_in[i] if i < len(points_in) else None
        bool_data = booleans_in[i] if i < len(booleans_in) else False
        
        # Ensure they are lists so we can zip them
        pt_list = pt_data if isinstance(pt_data, list) else [pt_data]
        bool_list = bool_data if isinstance(bool_data, list) else [bool_data]
        
        # Pad boolean list if it's shorter than points list (defaults to normal damper)
        while len(bool_list) < len(pt_list):
            bool_list.append(False)
            
        # Zip them together: (Point, Boolean)
        paired_data = list(zip(pt_list, bool_list))
        
        # Sort the pairs from Start to End so we process downstream correctly
        loc_curve = duct.Location.Curve
        duct_start = loc_curve.GetEndPoint(0)
        
        # Sort by distance of the point to the start of the duct
        paired_data.sort(key=lambda pair: to_xyz(pair[0]).DistanceTo(duct_start))
        
        current_duct_element = duct
        
        # Process each point/boolean pair for this duct
        for raw_pt, is_motorized in paired_data:
            
            xyz_pt = to_xyz(raw_pt)
            
            # ---> SELECT FAMILY TYPE BASED ON IN[4] <---
            current_fam_type = motorized_fam_type if is_motorized else normal_fam_type
            
            # Re-fetch curve (it changes after every split!)
            curr_curve = current_duct_element.Location.Curve
            lineDirection = curr_curve.Direction 
            
            proj_result = curr_curve.Project(xyz_pt)
            
            if proj_result:
                center_point = proj_result.XYZPoint
                
                # A. PLACE & ROTATE (Passing the conditional current_fam_type)
                damper = placeFitting(current_duct_element, center_point, current_fam_type, lineDirection)
                doc.Regenerate()
                
                # B. GET CUT POINTS
                damper_conns = get_connectors(damper)
                curr_start = curr_curve.GetEndPoint(0)
                sorted_conns = sorted(damper_conns, key=lambda c: c.Origin.DistanceTo(curr_start))
                
                cut_pt_A = sorted_conns[0].Origin
                cut_pt_B = sorted_conns[-1].Origin 
                
                # C. SPLIT 1
                proj_A = curr_curve.Project(cut_pt_A)
                p1 = proj_A.XYZPoint if proj_A else cut_pt_A
                
                new_id_1 = MechanicalUtils.BreakCurve(doc, current_duct_element.Id, p1)
                
                # D. SPLIT 2 (Try Both Logic)
                ducts_to_check = [current_duct_element.Id, new_id_1]
                final_duct_ids = []
                second_split_success = False
                
                for d_id in ducts_to_check:
                    d_elem = doc.GetElement(d_id)
                    if not d_elem: continue
                    
                    if not second_split_success:
                        try:
                            c_curve = d_elem.Location.Curve
                            proj_B = c_curve.Project(cut_pt_B)
                            if proj_B:
                                p2 = proj_B.XYZPoint
                                if not (p2.IsAlmostEqualTo(c_curve.GetEndPoint(0)) or p2.IsAlmostEqualTo(c_curve.GetEndPoint(1))):
                                    new_id_2 = MechanicalUtils.BreakCurve(doc, d_id, p2)
                                    final_duct_ids.append(d_id)
                                    final_duct_ids.append(new_id_2)
                                    second_split_success = True
                                    continue 
                        except: pass
                    final_duct_ids.append(d_id)
                
                # E. FIND MIDDLE & DELETE
                duct_objs = [doc.GetElement(ide) for ide in final_duct_ids]
                mid_duct = None
                side_ducts = []
                closest_dist = 10000.0
                
                for d in duct_objs:
                    if d is None: continue
                    crv = d.Location.Curve
                    mid_pt = (crv.GetEndPoint(0) + crv.GetEndPoint(1)) / 2
                    dist = mid_pt.DistanceTo(center_point)
                    
                    if dist < 0.5: 
                        if dist < closest_dist:
                            if mid_duct: side_ducts.append(mid_duct)
                            mid_duct = d
                            closest_dist = dist
                        else:
                            side_ducts.append(d)
                    else:
                        side_ducts.append(d)
                
                if mid_duct: doc.Delete(mid_duct.Id)
                
                # F. CONNECT
                for d in side_ducts:
                    connect_duct_to_damper(d, damper)
                
                placed_dampers_for_this_duct.append(damper)
                
                # G. UPDATE CURRENT DUCT (For next point in loop)
                downstream_duct = None
                min_dist_to_damper = 10000.0
                
                for d in side_ducts:
                    try:
                        d_start = d.Location.Curve.GetEndPoint(0)
                        dist = d_start.DistanceTo(center_point)
                        if dist < min_dist_to_damper:
                            min_dist_to_damper = dist
                            downstream_duct = d
                    except: pass
                
                if downstream_duct:
                    current_duct_element = downstream_duct
                    
    except Exception as e:
        placed_dampers_for_this_duct.append("Error: " + str(e))
        
    output_list.append(placed_dampers_for_this_duct)

TransactionManager.Instance.TransactionTaskDone()

OUT = output_list
# ----------------------------------------
mepfitting_bypointsandcurve_2 = Python(IN[0]=code_block_64.out2, IN[1]=code_block_64.out3, IN[2]=fireDamperUI.RoundFD, IN[3]=fireDamperUI.RoundShaft, IN[4]=join_7)  # "MEPFitting.ByPointsAndCurve(Damper elevation and double splitting )"; IronPython2; same code as mepfitting_bypointsandcurve
list_create_3 = List.Create(item0=mepfitting_bypointsandcurve, item1=mepfitting_bypointsandcurve_2)

# group: getting ducts which have more than two dampers are placed
countTrue = List.CountTrue(list=python_empty_2_false@L2)
code_block_71 = CodeBlock(count=countTrue) { count>=2; }
filterByBoolMask_38 = List.FilterByBoolMask(list=ducts, mask=code_block_71)

# group: QA QC - Two dampers are placed
code_block_72 = CodeBlock { "Review - Duct has more than one dampers placed"; }
flatten_28 = List.Flatten(list=filterByBoolMask_38.in)
count_6 = List.Count(list=flatten_28)
cycle_6 = List.Cycle(list=code_block_72, amount=count_6)

# group: QC - short duct length
code_block_73 = CodeBlock(MESSAGE_=code_block_61.out3) { MESSAGE_; }
code_block_74 = CodeBlock(duct_=code_block_61.out2) { duct_; }

list_create_4 = List.Create(item0=cycle_6, item1=code_block_73)
flatten_29 = List.Flatten(list=list_create_4)
list_create_5 = List.Create(item0=flatten_28, item1=code_block_74)
flatten_30 = List.Flatten(list=list_create_5)

# group: warning txt file on desktop
code_block_75 = CodeBlock { true; "Warnings - Fire Damper Issues"; null; }
name_2 = Element.Name(element=flatten_30)
python_script_8 = Python(IN[0]=code_block_75.out1, IN[1]=flatten_30, IN[2]=name_2, IN[3]=flatten_29)  # CPython3
# ---------- python_script_8.python (191 lines) ----------
import os
import datetime
import clr

# -------------------------------
# SYSTEM / DESKTOP PATH (IRONPYTHON SAFE)
# -------------------------------

clr.AddReference("System")
import System

desktop_dir = System.Environment.GetFolderPath(
    System.Environment.SpecialFolder.Desktop
)

warnings_dir = os.path.join(desktop_dir, "DAR_WARNINGS")
if not os.path.exists(warnings_dir):
    os.makedirs(warnings_dir)

# -------------------------------
# REVIT / DYNAMO IMPORTS
# -------------------------------

clr.AddReference("RevitServices")
from RevitServices.Persistence import DocumentManager

clr.AddReference("RevitAPI")
from Autodesk.Revit.DB import *

clr.AddReference("RevitNodes")
import Revit
clr.ImportExtensions(Revit.Elements)

doc = DocumentManager.Instance.CurrentDBDocument

# -------------------------------
# INPUTS
# -------------------------------

title = IN[0]
elements = IN[1]
names = IN[2]
warnings = IN[3]

# Halt execution and prevent file creation if any of the three are empty or None
if not elements or not names or not warnings:
    raise Exception("Elements, names, and warnings cannot be empty. No file created.")

use_names = len(names) == len(elements)

# -------------------------------
# SAFE LEVEL RESOLUTION
# -------------------------------
def get_level_name_safe(elem):
    try:
        # Direct properties
        if hasattr(elem, "LevelId"):
            lvl = doc.GetElement(elem.LevelId)
            if lvl: return lvl.Name

        if hasattr(elem, "Level") and elem.Level:
            return elem.Level.Name

        if hasattr(elem, "GenLevel") and elem.GenLevel:
            return elem.GenLevel.Name

        # Common parameters fallback
        for bip in [
            BuiltInParameter.INSTANCE_REFERENCE_LEVEL_PARAM,
            BuiltInParameter.SCHEDULE_LEVEL_PARAM,
            BuiltInParameter.INSTANCE_SCHEDULE_ONLY_LEVEL_PARAM,
            BuiltInParameter.RBS_START_LEVEL_PARAM
        ]:
            try:
                p = elem.get_Parameter(bip)
                if p:
                    lvl = doc.GetElement(p.AsElementId())
                    if lvl: return lvl.Name
            except:
                pass
    except:
        pass

    return "Unknown"

# -------------------------------
# BUILD SORTABLE DATA
# -------------------------------

sortable = []

for idx, dyn_elem in enumerate(elements):
    revit_elem = None
    level_name = "Unknown"
    elevation = float("inf")

    try:
        revit_elem = UnwrapElement(dyn_elem)
        level_name = get_level_name_safe(revit_elem)

        if level_name != "Unknown":
            lvl = next(
                (l for l in FilteredElementCollector(doc).OfClass(Level)
                 if l.Name == level_name),
                None
            )
            if lvl:
                elevation = lvl.Elevation
    except:
        pass

    sortable.append({
        "index": idx,
        "element": revit_elem,
        "level_name": level_name,
        "elevation": elevation
    })

# -------------------------------
# SORT (BY LEVEL, UNKNOWN LAST)
# -------------------------------

sortable_sorted = sorted(
    sortable,
    key=lambda x: (x["elevation"], x["index"])
)

# -------------------------------
# PROJECT NAME
# -------------------------------

project_name = (
    os.path.splitext(os.path.basename(doc.PathName))[0]
    if doc.PathName else "Unsaved_Project"
)

# -------------------------------
# BUILD TXT CONTENT
# -------------------------------

lines = []
now_str = datetime.datetime.now().strftime("%Y-%m-%d %H:%M:%S")

lines.append("PROJECT|{}".format(project_name))
lines.append("TITLE|{}".format(title))
lines.append("GENERATED_ON|{}".format(now_str))
lines.append("")

for i, item in enumerate(sortable_sorted):
    idx = item["index"]
    elem = item["element"]

    elem_id = ""
    elem_name = ""

    if elem:
        try:
            elem_id = elem.Id.IntegerValue
            elem_name = elem.Name
        except:
            pass

    if use_names:
        elem_name = names[idx]

    lines.append(
        "ROW|{}|{}|{}|{}|{}".format(
            i + 1,
            item["level_name"],
            elem_id,
            elem_name,
            warnings[idx]
        )
    )

# -------------------------------
# WRITE FILE
# -------------------------------

timestamp = datetime.datetime.now().strftime("%Y%m%d_%H%M%S")
file_name = "{}_DAR_Warnings_{}.txt".format(project_name, timestamp)
file_path = os.path.join(warnings_dir, file_name)

with open(file_path, "w") as f:
    f.write("\n".join(lines))

# -------------------------------
# OUTPUT
# -------------------------------

OUT = file_path
# ----------------------------------------

code_block_76 = CodeBlock(pass=flatten_29, wait=python_script_8) { [pass,wait][0]; }
python_script_9 = Python(IN[0]=filterByBoolMask_30.in, IN[1]=filterByBoolMask_30.out, IN[2]=flatten_30)  # CPython3
# ---------- python_script_9.python (66 lines) ----------
import clr

# Helper function to safely flatten nested lists and extract Element IDs
def extract_id_set(input_data):
    if not input_data:
        return set()
        
    flat_list = []
    def flatten(item):
        if isinstance(item, (list, tuple)):
            for sub_item in item:
                flatten(sub_item)
        elif item is not None:
            flat_list.append(item)
            
    flatten(input_data)
    
    id_set = set()
    for elem in flat_list:
        try:
            # Handle both Dynamo unwrapped elements and raw Revit DB elements
            if hasattr(elem, "InternalElement"):
                id_set.add(elem.InternalElement.Id.IntegerValue)
            elif hasattr(elem, "Id"):
                id_set.add(elem.Id.IntegerValue)
        except:
            pass
            
    return id_set

# --- INPUTS ---
in0 = IN[0] if len(IN) > 0 else []
in1 = IN[1] if len(IN) > 1 else []
in2 = IN[2] if len(IN) > 2 else []

# Convert inputs into mathematical Sets of Element IDs
set0 = extract_id_set(in0)
set1 = extract_id_set(in1)
set2 = extract_id_set(in2)

# State flags
has_0 = len(set0) > 0
empty_0 = len(set0) == 0

empty_1 = len(set1) == 0
empty_2 = len(set2) == 0

# Ensuring IN[1] actually has elements for the "has all" logic to make sense
has_1 = len(set1) > 0 

# --- EVALUATE LOGIC RULES ---

# 1. IF IN[1], IN[2] ARE EMPTY AND IN[0] HAS SOME ELEMENTS
cond1 = empty_1 and empty_2 and has_0

# 2. IF IN[0] IS EMPTY AND IN[2] HAS ALL ELEMENTS OF IN[1]
cond2 = empty_0 and has_1 and set1.issubset(set2)

# 3. IF IN[0] HAS DUCTS AND IN[2] HAS ALL DUCTS OF IN[1]
cond3 = has_0 and has_1 and set1.issubset(set2)

# --- OUTPUT ---
if cond1 or cond2 or cond3:
    OUT = True
else:
    OUT = False
# ----------------------------------------

# group: Failed-completed popup
flatten_31 = List.Flatten(list=list_create_3)
failed_completed_popup = Python(IN[0]=flatten_31, IN[1]=code_block_76, IN[2]=python_script_9)  # IronPython2
# ---------- failed_completed_popup.python (155 lines) ----------
import clr

clr.AddReference("PresentationFramework")
clr.AddReference("PresentationCore")
clr.AddReference("WindowsBase")

import System
from System.Windows import Window, WindowStartupLocation, FontWeights, Thickness
from System.Windows.Controls import TextBlock, Button, StackPanel, ScrollViewer
from System.Windows import HorizontalAlignment
from System.Windows.Media import Brushes

clr.AddReference('RevitAPI')
from Autodesk.Revit.DB import *

clr.AddReference("RevitNodes")
import Revit
clr.ImportExtensions(Revit.Elements)

# -------------------------------
# INPUTS
# -------------------------------
dampers_input = IN[0] if len(IN) > 0 else None
warnings_input = IN[1] if len(IN) > 1 else None

# Safe extraction for the boolean flag
is_already_placed = False
if len(IN) > 2 and IN[2] is not None:
    val = IN[2]
    if isinstance(val, list) and len(val) > 0:
        is_already_placed = bool(val[0])
    else:
        is_already_placed = bool(val)

# -------------------------------
# HELPERS
# -------------------------------
def flatten_list(lst):
    if not lst:
        return []
    result = []
    for i in lst:
        if isinstance(i, (list, tuple)):
            result.extend(flatten_list(i))
        elif i is not None:
            result.append(i)
    return result

def safe_unwrap_and_flatten(inp):
    if not inp:
        return []
    try:
        return flatten_list(UnwrapElement(inp))
    except:
        return flatten_list(inp)

# -------------------------------
# COUNTS
# -------------------------------
damper_list = safe_unwrap_and_flatten(dampers_input)
warning_list = safe_unwrap_and_flatten(warnings_input)

damper_count = len(damper_list)
warning_count = len(warning_list)

# -------------------------------
# POPUP WINDOW
# -------------------------------
class ClashPopup(Window):
    def __init__(self, message, bg_color, title="UI - DarCDT-Mechanical [2025]"):
        self.Title = title
        self.Width = 440
        self.Height = 210
        self.WindowStartupLocation = WindowStartupLocation.CenterScreen
        self.Background = bg_color
        self.ResizeMode = 0

        panel = StackPanel()
        panel.Margin = Thickness(20)

        scroll = ScrollViewer()
        scroll.VerticalScrollBarVisibility = 0
        scroll.HorizontalScrollBarVisibility = 0

        txt = TextBlock()
        txt.Text = message
        txt.FontSize = 16
        txt.TextWrapping = System.Windows.TextWrapping.Wrap
        txt.TextAlignment = System.Windows.TextAlignment.Center
        txt.FontWeight = FontWeights.SemiBold
        txt.Foreground = Brushes.White
        txt.HorizontalAlignment = HorizontalAlignment.Center

        scroll.Content = txt

        btn = Button()
        btn.Content = "OK"
        btn.Width = 90
        btn.Height = 36
        btn.HorizontalAlignment = HorizontalAlignment.Center
        btn.Margin = Thickness(0, 16, 0, 0)
        btn.Background = Brushes.White
        btn.Foreground = bg_color
        btn.FontWeight = FontWeights.Bold
        btn.Click += self.close_window

        panel.Children.Add(scroll)
        panel.Children.Add(btn)
        self.Content = panel

    def close_window(self, sender, args):
        self.Close()

# -------------------------------
# MESSAGE + COLOR LOGIC
# -------------------------------
if is_already_placed:
    # SCENARIO A: Dampers were already present
    if warning_count == 0:
        message = "No new Fire damper needed.\nAll required dampers are already placed."
        bg_color = Brushes.SeaGreen
    else:
        message = (
            "No new Fire damper needed.\n"
            "However, there are {} warnings.\n"
            "Open 'Warning' Tool from MDP to check the issues."
        ).format(warning_count)
        bg_color = Brushes.Goldenrod
else:
    # SCENARIO B: Normal processing
    if damper_count == 0:
        message = "No Fire damper placed\nCheck the inputs again"
        bg_color = Brushes.IndianRed
    else:
        if warning_count == 0:
            message = (
                "Total Fire damper placed : {}\n"
                "No warnings found"
            ).format(damper_count)
            bg_color = Brushes.SeaGreen
        else:
            message = (
                "Total Fire damper placed : {}\n"
                "There are {} warnings\n"
                "Open 'Warning' Tool from MDP to check the issues"
            ).format(damper_count, warning_count)
            bg_color = Brushes.Goldenrod

# -------------------------------
# SHOW POPUP
# -------------------------------
popup = ClashPopup(message, bg_color)
popup.ShowDialog()

OUT = message
# ----------------------------------------
